# Dynamo graph Maximize Window Views.dyn (Dynamo 2.5.0.7186)
# packages: Refinery Toolkit for Space Planning 0.0.1, GenerativeDesign 0.75.1

# note: DYNAMO PROJECT
# Maximum Window Views.dyn
# note: ASSOCIATED FILE(S)
# N/A
# note: DYNAMO VERSION
# 2.5
# note: ADDITIONAL COMMENTS
# N/A
# note: REQUIRED DYNAMO PACKAGES
# Refinery Toolkit for Space Planning
# note: AUTHOR(S) / CREATION DATE
# AEC Generative Design Team / Jan. 2020
# note: DESCRIPTION
# This graph generates various viewpoints. Calculates scores that represent the quality of views to the outside from those points.
# The goal is to maximize "View to outside score" and minimize the "Average angl to windows".
# note: Variables / Inputs
# Red indicates Variables that can be altered per project and must be set accordingly before running the script.
# note: Checking / Outputs
# Orange indicates checking nodes to ensure the script has deployed correctly.
# note: Working / Functions
# Green indicates the working of the script. No changes should be made in these groups unless advised.

# group: Manual Inputs
# note: Select a room from the Revit model
select_room = DSModelRoomSelection()  # nothing selected; graph input
# note: Select all windows/curtain walls in the room
select_multiple_window_or = DSModelFamilyInstanceMutlipleSelection()  # "Select multiple window or curtain elements"; nothing selected; graph input
# note: Select all the possible obstructions in the room (columns, air terminals, furniture etc.)
select_obstruction_elements = DSModelElementMutlipleSelection()  # nothing selected; graph input
# note: Select an Element to Analyse its view
select_element_to_calculate_view = DSModelElementSelection()  # "Select element to calculate view from"; nothing selected; graph input

# group: Room Boundary
centerBoundary = Room.CenterBoundary(room=select_room)
byJoinedCurves = PolyCurve.ByJoinedCurves(curves=centerBoundary)
length = Curve.Length(curve=byJoinedCurves)
sortByKey = List.SortByKey(list=byJoinedCurves, keys=length)
lastItem = List.LastItem(list=sortByKey.sorted_list)
remember = Data.Remember(lastItem)
byPatch = Surface.ByPatch(closedCurve=remember)
lastItem_2 = List.LastItem(list=sortByKey.sorted_keys)
indexOf = List.IndexOf(list=length, element=lastItem_2)
getItemAtIndex = List.GetItemAtIndex(list=centerBoundary, index=indexOf)
startPoint = Curve.StartPoint(curve=getItemAtIndex)
asVector = Point.AsVector(point=startPoint)
X = Vector.X(vector=asVector)
Y = Vector.Y(vector=asVector)
Z = Vector.Z(vector=asVector)
byCoordinates = Point.ByCoordinates(x=X, y=Y, z=Z)
byPoints = Polygon.ByPoints(points=byCoordinates)
remember_2 = Data.Remember(byPoints)

# group: Generative Design Inputs
# note: U and V values to position to point within Generative Design
viewpoint_position_x = DoubleSlider(0.32, range=0.01..0.99 step 0.01)  # graph input
viewpoint_position_y = DoubleSlider(0.8, range=0.1..0.99 step 0.01)  # graph input

# group: View Point
pointAtParameter = Surface.PointAtParameter(surface=byPatch, u=viewpoint_position_x, v=viewpoint_position_y)
getLocation = Element.GetLocation(element=select_element_to_calculate_view)
remember_3 = Data.Remember(getLocation)
geometry = Element.Geometry(element=select_element_to_calculate_view)
remember_4 = Data.Remember(geometry)

# group: Get Windows/Curtain Walls Locations
geometry_2 = Element.Geometry(element=select_multiple_window_or)
remember_5 = Data.Remember(geometry_2)
byUnion = Solid.ByUnion(solids=remember_5)
explode = Geometry.Explode(geometry=byUnion)
flatten = List.Flatten(list=explode@L2)
code_block = CodeBlock { 0.5; }
pointAtParameter_2 = Surface.PointAtParameter(surface=flatten, u=code_block, v=code_block)
Z_2 = Point.Z(point=pointAtParameter_2)
sortByKey_2 = List.SortByKey(list=flatten@L2, keys=Z_2@L2)
firstItem = List.FirstItem(list=sortByKey_2.sorted_list@L2)
code_block_2 = CodeBlock { 0; 1; }
pointAtParameter_3 = Surface.PointAtParameter(surface=firstItem, u=code_block_2.out0, v=code_block_2.out0)
closestPointTo = Geometry.ClosestPointTo(geometry=remember, other=pointAtParameter_3)
pointAtParameter_4 = Surface.PointAtParameter(surface=firstItem, u=code_block_2.out1, v=code_block_2.out1)
closestPointTo_2 = Geometry.ClosestPointTo(geometry=remember, other=pointAtParameter_4)
byStartPointEndPoint = Line.ByStartPointEndPoint(startPoint=closestPointTo, endPoint=closestPointTo_2)

# group: Rebuild Polycurve as Polyline
explode_2 = Geometry.Explode(geometry=remember_2)
startPoint_2 = Curve.StartPoint(curve=explode_2)
byPoints_2 = Polygon.ByPoints(points=startPoint_2)

# group: Surface from Obstacles
code_block_3 = CodeBlock { 1; }
faces = Element.Faces(element=select_obstruction_elements)
code_block_4 = CodeBlock(surface1=faces)
# ---------- code_block_4.designscript (5 lines) ----------
midpoint = Surface.PointAtParameter(surface1, 0.5, 0.5);
normalAtmidpoint = Surface.NormalAtPoint(surface1, midpoint);
normalVector = Vector.Normalized(normalAtmidpoint);
zAxis = Vector.ZAxis();
zAxisReversed = Vector.Reverse(zAxis);
# ----------------------------------------
string_from_object = FromObject(obj=code_block_4.normalVector)
string_from_object_2 = FromObject(obj=code_block_4.zAxis)
code_block_5 = CodeBlock(normalVector=string_from_object, zAxis=string_from_object_2) { isSurfaceinXYplane = normalVector == zAxis; }
filterByBoolMask = List.FilterByBoolMask(list=faces, mask=code_block_5)
area = Surface.Area()  # unwired: surface
sortByFunction = List.SortByFunction(list=filterByBoolMask.in@L2, func=area)
code_block_6 = CodeBlock(surfacesXY=sortByFunction)
# ---------- code_block_6.designscript (3 lines) ----------
biggestXYsurface = List.LastItem(surfacesXY@L2<1>);
curve1 = Surface.PerimeterCurves(biggestXYsurface);
point1 = Curve.StartPoint(curve1);
# ----------------------------------------
count = List.Count(list=code_block_6.point1@L2)
eq = code_block_3 == count
byGeometry = BoundingBox.ByGeometry(geom=code_block_6.curve1)
maxPoint = BoundingBox.MaxPoint(boundingBox=byGeometry)
minPoint = BoundingBox.MinPoint(boundingBox=byGeometry)
code_block_7 = CodeBlock(maxPt=maxPoint, minPt=minPoint)
# ---------- code_block_7.designscript (8 lines) ----------
// center point
centerX = (maxPt.X + minPt.X) / 2;
centerY = (maxPt.Y + minPt.Y) / 2;
Point.ByCoordinates(centerX, centerY, maxPt.Z);

// width and length
maxPt.X - minPt.X;
maxPt.Y - minPt.Y;
# ----------------------------------------
byOriginNormal = Plane.ByOriginNormal(origin=code_block_7.out2)
byWidthLength = Rectangle.ByWidthLength(cs=byOriginNormal, width=code_block_7.out3, length=code_block_7.out4)
explode_3 = Geometry.Explode(geometry=byWidthLength)
startPoint_3 = Curve.StartPoint(curve=explode_3)
python_script = Python(IN[0]=eq, IN[1]=startPoint_3, IN[2]=code_block_6.point1)
# ---------- python_script.python (20 lines) ----------
# Load the Python Standard and DesignScript Libraries
import sys
import clr
clr.AddReference('ProtoGeometry')
from Autodesk.DesignScript.Geometry import *

# The inputs to this node will be stored as a list in the IN variables.
dataEnteringNode = IN

# Place your code below this line
point_list = []

for i in range(len(IN[0])):
	if IN[0][i] == True:
		point_list.append(IN[1][i])
	else:
		point_list.append(IN[2][i])

# Assign your output to the OUT variable.
OUT = point_list
# ----------------------------------------
code_block_8 = CodeBlock(FloorZVals=closestPointTo_2) { Point.Z(FloorZVals[0]); }
code_block_9 = CodeBlock(point1=python_script, floorZValue=code_block_8)
# ---------- code_block_9.designscript (5 lines) ----------
polygon1 = Polygon.ByPoints(point1);
point2 = Curve.StartPoint(polygon1);
t3 = Point.Z(point2)-floorZValue;
zAxisReversed = Vector.Reverse(Vector.ZAxis());
surfaces = Geometry.Translate(polygon1,zAxisReversed,t3);
# ----------------------------------------
remember_6 = Data.Remember(code_block_9.surfaces)

# group: Rebuild Polycurve as Polyline
explode_4 = Geometry.Explode(geometry=remember_6)
startPoint_4 = Curve.StartPoint(curve=explode_4)
byPoints_3 = Polygon.ByPoints(points=startPoint_4)

# group: Refinery Toolkit - View To Outside
ofLinesFromOrigin = Autodesk.RefineryToolkits.SpacePlanning.Analyze.Visibility.OfLinesFromOrigin(origin=pointAtParameter@L1, targetLines=byStartPointEndPoint, boundary=byPoints_2, obstructions=byPoints_3)
firstItem_2 = List.FirstItem(list=ofLinesFromOrigin.Percentage_visible)

# group: Visualize views to outside
flatten_2 = List.Flatten(list=ofLinesFromOrigin.Visible_items)
flatten_3 = List.Flatten(list=ofLinesFromOrigin.Visible_items)
startPoint_5 = Curve.StartPoint(curve=flatten_3)
code_block_10 = CodeBlock(viewpoint=pointAtParameter) { viewpoint; }
byStartPointEndPoint_2 = Line.ByStartPointEndPoint(startPoint=startPoint_5, endPoint=code_block_10, lacing=Longest)
endPoint = Curve.EndPoint(curve=flatten_3)
byStartPointEndPoint_3 = Line.ByStartPointEndPoint(startPoint=endPoint, endPoint=code_block_10, lacing=Longest)
list_create = List.Create(item0=flatten_2, item1=byStartPointEndPoint_2, item2=byStartPointEndPoint_3)
transpose = List.Transpose(lists=list_create)
color_palette = ColorPalette({R: 128, G: 128, B: 0, A: 255})
byGeometryColor = Modifiers.GeometryColor.ByGeometryColor(geometry=transpose, color=color_palette)
byJoinedCurves_2 = PolyCurve.ByJoinedCurves(curves=transpose)
byPatch_2 = Surface.ByPatch(closedCurve=byJoinedCurves_2)
color_palette_2 = ColorPalette({R: 255, G: 255, B: 0, A: 255})
byGeometryColor_2 = Modifiers.GeometryColor.ByGeometryColor(geometry=byPatch_2, color=color_palette_2)

# group: Visualization of Obstacles , Walls and Windows
color_palette_3 = ColorPalette({R: 255, G: 69, B: 0, A: 255})
byGeometryColor_3 = Modifiers.GeometryColor.ByGeometryColor(geometry=remember_6, color=color_palette_3)
color_palette_4 = ColorPalette({R: 218, G: 152, B: 65, A: 255})
byGeometryColor_4 = Modifiers.GeometryColor.ByGeometryColor(geometry=remember_2, color=color_palette_4)
color_palette_5 = ColorPalette({R: 0, G: 73, B: 255, A: 255})
byGeometryColor_5 = Modifiers.GeometryColor.ByGeometryColor(geometry=byStartPointEndPoint, color=color_palette_5)

# group: Find Point To Move Element
code_block_11 = CodeBlock(pointIN=pointAtParameter, elemLocation=remember_3, elemGeometry=remember_4)
# ---------- code_block_11.designscript (18 lines) ----------
pX = Point.X(pointIN);
pY = Point.Y(pointIN);
pZ = Point.Z(pointIN);
geom = elemLocation;
geomX = Point.X(geom);
geomY = Point.Y(geom);
geomZ = Point.Z(geom);
geomBB = BoundingBox.ByGeometry(elemGeometry);
geomMIN = BoundingBox.MinPoint(geomBB);
geomMAX = BoundingBox.MaxPoint(geomBB);
geomLINE = Line.ByStartPointEndPoint(geomMIN, geomMAX);
geomMID = Curve.PointAtParameter(geomLINE, 0.5);
geomMIDX = Point.X(geomMID);
geomMIDY = Point.Y(geomMID);
moveX = pX + geomX - geomMIDX;
moveY = pY + geomY - geomMIDY;
moveZ = pZ + geomZ;
pointMOVE = Point.ByCoordinates(moveX, moveY, moveZ);
# ----------------------------------------

# group: Create Revit Elements
firstItem_3 = List.FirstItem(list=code_block_11.pointMOVE)
list_create_2 = List.Create(item0=select_element_to_calculate_view, item1=firstItem_3)
gate = Data.Gate(false, list_create_2)
code_block_12 = CodeBlock(a=gate) { a[0]; a[1]; }
setLocation = Element.SetLocation(element=code_block_12.out0, geometry=code_block_12.out1)

# group: Calculate Distance and Angle from Point to Windows
list_flatten_window_lines = List.Flatten(list=ofLinesFromOrigin.Visible_items)
code_block_13 = CodeBlock(windowlines=list_flatten_window_lines, t1=pointAtParameter)
# ---------- code_block_13.designscript (6 lines) ----------
midPoint = Curve.PointAtParameter(windowlines, 0.5);
minPoint = Curve.PointAtParameter(windowlines, 0);
maxPoint = Curve.PointAtParameter(windowlines, 1);
line1 = Line.ByStartPointEndPoint(t1<1L>, midPoint<1L>);
vector1 = Vector.ByTwoPoints(t1, midPoint);
vector2 = Vector.ByTwoPoints(minPoint, maxPoint);
# ----------------------------------------
code_block_14 = CodeBlock(a=code_block_13.line1) { a.Length; }
sum = Math.Sum(values=code_block_14)
angleWithVector = Vector.AngleWithVector(vector=code_block_13.vector1, otherVector=code_block_13.vector2, lacing=Longest)
code_block_15 = CodeBlock(a=angleWithVector) { ang = 90 - Math.Abs(a-90); }
average = Math.Average(numbers=code_block_15)

# group: Generative Design Outputs
view_to_outside_score = Watch(firstItem_2)  # graph output
distance_to_windows = Watch(sum)
average_angle_to_windows = Watch(average)  # graph output
