# Dynamo graph Three Box Massing.dyn (Dynamo 2.5.0.7186)
# packages: GenerativeDesign 0.75.1

# group: Three Box Massing Generative Design Graph Example
# note: DYNAMO VERSION
# 2.5
# note: ADDITIONAL COMMENTS
# N/A
# note: REQUIRED DYNAMO PACKAGES
# N/A
# note: DYNAMO PROJECT
# Three Box Massing.dyn
# note: ASSOCIATED FILE(S)
# N/A
# note: AUTHOR(S) / CREATION DATE
# AEC Generative Design Team / Jan. 2020
# note: DESCRIPTION
# This graph contains three Cuboids representing buildings. Cuboid One (C1) has a fixed location, but varies in Height. Cuboid Two (C2) and Cuboid Three (C3) can both vary in Location (Both X and Y directions) as well as Height.
# The graph uses Generative Design to find the minimum Surface Area (to minimize facade cost) and maximum Floor Area (to maximize rentable space).

# group: Input: Changeable variables
# note: NOTE:
# In order to see an 'Input' in Generative Design, you have to right-click on a compatible node and check the 'Is Input' option. Rename the node to see a legible input name in Generative Design.
# note: Variables / Inputs
# Red indicates Variables that can be altered per project and must be set accordingly before running the script.
# note: Working / Functions
# Green indicates the working of the script. No changes should be made in these groups unless advised.
box_1_height = DoubleSlider(160, range=20..200 step 10)  # graph input
box_2_position_x = DoubleSlider(34, range=0..50 step 1)  # graph input
box_2_position_y = DoubleSlider(0, range=0..50 step 1)  # graph input
box_2_height = DoubleSlider(120, range=20..200 step 10)  # graph input
box_3_position_x = DoubleSlider(52, range=20..70 step 1)  # graph input
box_3_position_y = DoubleSlider(40, range=20..70 step 1)  # graph input
# note: Checking / Outputs
# Orange indicates checking nodes to ensure the script has deployed correctly.
box_3_height = DoubleSlider(80, range=20..200 step 10)  # graph input

# group: Geometry [Dynamo]: Geometry Manipulation
byCoordinates = Point.ByCoordinates()
width = CodeBlock { 50; }
byLengths = Cuboid.ByLengths(origin=byCoordinates, width=width, length=width, height=box_1_height)
code_block = CodeBlock(h=box_1_height) { h/2; }
translate = Geometry.Translate(geometry=byLengths, zTranslation=code_block)
byCoordinates_2 = Point.ByCoordinates(x=box_2_position_x, y=box_2_position_y)
byLengths_2 = Cuboid.ByLengths(origin=byCoordinates_2, width=width, length=width, height=box_2_height)
code_block_2 = CodeBlock(h=box_2_height) { h/2; }
translate_2 = Geometry.Translate(geometry=byLengths_2, zTranslation=code_block_2)
byCoordinates_3 = Point.ByCoordinates(x=box_3_position_x, y=box_3_position_y)
byLengths_3 = Cuboid.ByLengths(origin=byCoordinates_3, width=width, length=width, height=box_3_height)
code_block_3 = CodeBlock(h=box_3_height) { h/2; }
translate_3 = Geometry.Translate(geometry=byLengths_3, zTranslation=code_block_3)
list_create = List.Create(item0=translate, item1=translate_2, item2=translate_3)
byUnion = Solid.ByUnion(solids=list_create)

# group: Add Floors for more detailed analysis of occupiable space
floor_height = DoubleInput(10)
code_block_4 = CodeBlock(FloorHeight=floor_height) { 0..200..FloorHeight; }
byCoordinates_4 = Point.ByCoordinates(z=code_block_4)
byOriginNormal = Plane.ByOriginNormal(origin=byCoordinates_4)
intersect = Geometry.Intersect(geometry=byUnion, other=byOriginNormal)
flatten = List.Flatten(list=intersect)

# group: Analysis: Floor Area
area = Surface.Area(surface=flatten)
sum = Math.Sum(values=area)

# group: Visualization: Colourizes Dynamo geometry in the Background Preview window
color_palette = ColorPalette({R: 5, G: 195, B: 222, A: 255})
byGeometryColor = Modifiers.GeometryColor.ByGeometryColor(geometry=byUnion, color=color_palette)

# group: Analysis: Surface Area
area_2 = Solid.Area(solid=byUnion)

# group: Output: Output information that can be used to filter results in Generative Design
floor_area = Watch(sum)  # graph output
# note: NOTE:
# In order to see an 'Output' in Generative Design, you have to right-click on a compatible node and check the 'Is
# Output' option. Rename the node to see a legible output name in Generative Design.
surface_area = Watch(area_2)  # graph output

# group: INTEGRATE - Revit Output
gate = Data.Gate(false, byUnion)
categories = Categories("OST_Mass")
code_block_5 = CodeBlock { "Building Mass"; }
byGeometry = DirectShape.ByGeometry(geometry=gate, category=categories, name=code_block_5)
