# Dynamo custom node [&] Arc.CenterPoint.dyf (Dynamo 2.0.2.6826)
# category: Ampersand.[&] Curve
# Works with a list of arcs.  Returns the center point for an arc or null if the item is not an arc.

code_block = CodeBlock { null; }
# note: Works with a list of arcs.  Returns the center point for an arc or null if the item is not an arc.
# note: Colin McCrone
# Twitter:  @ColinMcCrone
# LinkedIn: https://www.linkedin.com/in/colinmccrone
# Updated:  2019-05-20
# An example Dynamo script for how to use this node can be found in the 'extra' folder where the package files are stored. To find it, go to the Packages Menu and select "Manage Packages." Where Ampersand is listed, open the drop-down menu link at the right and choose "Show Root Directory." Open the "extra" folder to find the example file called AmpersandExamples.dyn.
arc = Input(arc: Autodesk.DesignScript.Geometry.Arc[])
type = Object.Type(obj=arc)
groupByKey = List.GroupByKey(list=arc, keys=type)
count = List.Count(list=groupByKey.groups@L2)
ofRepeatedItem = List.OfRepeatedItem(item=code_block, amount=count)
code_block_2 = CodeBlock { "Autodesk.DesignScript.Geometry.Arc"; true; }
eq = groupByKey.unique_keys == code_block_2.out0
indexOf = List.IndexOf(list=eq, element=code_block_2.out1)
getItemAtIndex = List.GetItemAtIndex(list=groupByKey.groups, index=indexOf)
centerPoint = Arc.CenterPoint(arc=getItemAtIndex)
replaceItemAtIndex = List.ReplaceItemAtIndex(list=ofRepeatedItem, index=indexOf, item=centerPoint)
flatten = List.Flatten(list=replaceItemAtIndex)
count_2 = List.Count(list=arc)
code_block_3 = CodeBlock(count=count_2) { 0..(count-1); }
groupByKey_2 = List.GroupByKey(list=code_block_3, keys=type)
flatten_2 = List.Flatten(list=groupByKey_2.groups)
sortByKey = List.SortByKey(list=flatten, keys=flatten_2)
firstItem = List.FirstItem(list=sortByKey.sorted_list)
point = Output(firstItem)
