# Dynamo custom node [&] Categories.ListAll.dyf (Dynamo 2.0.2.6826)
# category: Ampersand.[&] Revit
# List of all Revit Categories

# note: Colin McCrone
# Twitter:  @ColinMcCrone
# LinkedIn: https://www.linkedin.com/in/colinmccrone
# Updated:  2019-05-20
# An example Dynamo script for how to use this node can be found in the 'extra' folder where the package files are stored. To find it, go to the Packages Menu and select "Manage Packages." Where Ampersand is listed, open the drop-down menu link at the right and choose "Show Root Directory." Open the "extra" folder to find the example file called AmpersandExamples.dyn.
code_block = CodeBlock()
# ---------- code_block.designscript (524 lines) ----------
// Revit category names

["AdaptivePoints",
"AdaptivePoints_Lines",
"AdaptivePoints_Planes",
"AdaptivePoints_Points",
"AnalysisDisplayStyle",
"AnalysisResults",
"AnalyticalNodes",
"AnalyticalRigidLinks",
"AnnotationCrop",
"AnnotationCropSpecial",
"AreaColorFill",
"AreaInteriorFillVisibility",
"AreaLoads",
"AreaLoadTags",
"AreaReferenceVisibility",
"AreaRein",
"AreaReinBoundary",
"AreaReinSpanSymbol",
"AreaReinTags",
"Areas",
"AreaSchemeLines",
"AreaTags",
"Assemblies",
"AssemblyTags",
"BeamAnalytical",
"BeamAnalyticalTags",
"BeamEndSegment",
"BeamLocalCoordSys",
"BeamStartSegment",
"BeamSystemTags",
"BoundaryConditions",
"BraceAnalytical",
"BraceAnalyticalTags",
"BraceEndSegment",
"BraceLocalCoordSys",
"BraceStartSegment",
"BrokenSectionLine",
"BuildingPad",
"CableTray",
"CableTrayCenterLine",
"CableTrayDrop",
"CableTrayFitting",
"CableTrayFittingCenterLine",
"CableTrayFittingTags",
"CableTrayRiseDrop",
"CableTrayRun",
"CableTrayTags",
"CalloutBoundary",
"CalloutHeads",
"CalloutLeaderLine",
"Callouts",
"Camera_Lines",
"Cameras",
"Casework",
"CaseworkHiddenLines",
"CaseworkTags",
"Ceilings",
"CeilingsCutPattern",
"CeilingsDefault",
"CeilingsFinish1",
"CeilingsFinish2",
"CeilingsHiddenLines",
"CeilingsInsulation",
"CeilingsMembrane",
"CeilingsStructure",
"CeilingsSubstrate",
"CeilingTags",
"CenterLines",
"CLines",
"ColorFillLegends",
"ColumnAnalytical",
"ColumnAnalyticalRigidLinks",
"ColumnAnalyticalTags",
"ColumnEndSegment",
"ColumnLocalCoordSys",
"Columns",
"ColumnsHiddenLines",
"ColumnStartSegment",
"CommunicationDevices",
"CommunicationDeviceTags",
"Conduit",
"ConduitCenterLine",
"ConduitDrop",
"ConduitFitting",
"ConduitFittingCenterLine",
"ConduitFittingTags",
"ConduitRiseDrop",
"ConduitRun",
"ConduitTags",
"ContourLabels",
"Cornices",
"CropBoundary",
"CropBoundarySpecial",
"CurtainGrids",
"CurtainGridsCurtaSystem",
"CurtainGridsRoof",
"CurtainGridsWall",
"CurtainWallMullions",
"CurtainWallMullionsHiddenLines",
"CurtainWallPanels",
"CurtainWallPanelsHiddenLines",
"CurtainWallPanelTags",
"CurtaSystem",
"CurtaSystemHiddenLines",
"CurtaSystemTags",
"CurvesThinLines",
"CurvesWideLines",
"DataDevices",
"DataDeviceTags",
"DemolishedLines",
"DetailComponents",
"DetailComponentsHiddenLines",
"DetailComponentTags",
"Dimensions",
"DisplacementPath",
"DividedSurface_Gridlines",
"DividedSurface_Nodes",
"DividedSurface_PatternLines",
"Doors",
"DoorsFrameMullionProjection",
"DoorsGlassProjection",
"DoorsHiddenLines",
"DoorsOpeningProjection",
"DoorsPanelProjection",
"DoorTags",
"DuctAccessory",
"DuctAccessoryTags",
"DuctColorFillLegends",
"DuctColorFills",
"DuctCurves",
"DuctCurvesCenterLine",
"DuctCurvesDrop",
"DuctCurvesRiseDrop",
"DuctFitting",
"DuctFittingCenterLine",
"DuctFittingTags",
"DuctInsulations",
"DuctInsulationsTags",
"DuctLinings",
"DuctLiningsTags",
"DuctSystem",
"DuctSystem_Reference_Visibility",
"DuctTags",
"DuctTerminal",
"DuctTerminalTags",
"EdgeSlab",
"ElectricalCircuit",
"ElectricalEquipment",
"ElectricalEquipmentHiddenLines",
"ElectricalEquipmentTags",
"ElectricalFixtures",
"ElectricalFixturesHiddenLines",
"ElectricalFixtureTags",
"ElectricalInternalCircuits",
"Elev",
"ElevationMarks",
"Entourage",
"EntourageHiddenLines",
"FabricAreaBoundary",
"FabricAreas",
"FabricAreaSketchEnvelopeLines",
"FabricAreaSketchSheetsLines",
"FabricReinforcement",
"FabricReinforcementBoundary",
"FabricReinforcementTags",
"FabricReinforcementWire",
"FabricReinSpanSymbol",
"Fascia",
"FilledRegion",
"FireAlarmDevices",
"FireAlarmDeviceTags",
"FlexDuctCurves",
"FlexDuctCurvesCenterLine",
"FlexDuctCurvesPattern",
"FlexDuctTags",
"FlexPipeCurves",
"FlexPipeCurvesCenterLine",
"FlexPipeCurvesPattern",
"FlexPipeTags",
"FloorAnalytical",
"FloorAnalyticalTags",
"FloorLocalCoordSys",
"Floors",
"FloorsCutPattern",
"FloorsDefault",
"FloorsFinish1",
"FloorsFinish2",
"FloorsInsulation",
"FloorsInteriorEdges",
"FloorsMembrane",
"FloorsStructure",
"FloorsSubstrate",
"FloorsSurfacePattern",
"FloorTags",
"FndSlabLocalCoordSys",
"FootingSpanDirectionSymbol",
"FoundationSlabAnalytical",
"FoundationSlabAnalyticalTags",
"Furniture",
"FurnitureSystems",
"FurnitureSystemsHiddenLines",
"FurnitureSystemTags",
"FurnitureTags",
"GbXML_Opening",
"GbXML_SType_Interior",
"GbXMLFaces",
"GenericAnnotation",
"GenericLines",
"GenericModel",
"GenericModelHiddenLines",
"GenericModelTags",
"Girder",
"GridHeads",
"Grids",
"GuideGrid",
"Gutter",
"HiddenFloorLines",
"HiddenLines",
"HiddenStructuralColumnLines",
"HiddenStructuralFoundationLines",
"HiddenStructuralFramingLines",
"HiddenWallLines",
"HorizontalBracing",
"HVAC_Zones",
"HVAC_Zones_Boundary",
"HVAC_Zones_ColorFill",
"HVAC_Zones_InteriorFill_Visibility",
"HVAC_Zones_Reference_Visibility",
"ImportObjectStyles",
"InsulationLines",
"InternalAreaLoads",
"InternalAreaLoadTags",
"InternalLineLoads",
"InternalLineLoadTags",
"InternalLoads",
"InternalPointLoads",
"InternalPointLoadTags",
"IsolatedFoundationAnalytical",
"IsolatedFoundationAnalyticalTags",
"Joist",
"KeynoteTags",
"KickerBracing",
"LevelHeads",
"Levels",
"LightingDevices",
"LightingDeviceTags",
"LightingFixtures",
"LightingFixturesHiddenLines",
"LightingFixtureSource",
"LightingFixtureTags",
"LineLoads",
"LineLoadTags",
"Lines",
"LinesBeyond",
"LinesHiddenLines",
"LinksAnalytical",
"LoadCases",
"LoadCasesAccidental",
"LoadCasesDead",
"LoadCasesLive",
"LoadCasesRoofLive",
"LoadCasesSeismic",
"LoadCasesSnow",
"LoadCasesTemperature",
"LoadCasesWind",
"Loads",
"MaskingRegion",
"Mass",
"MassAreaFaceTags",
"MassExteriorWall",
"MassFloor",
"MassForm",
"MassGlazing",
"MassHiddenLines",
"MassInteriorWall",
"MassOpening",
"MassRoof",
"MassShade",
"MassSkylights",
"MassTags",
"MassZone",
"Matchline",
"Materials",
"MaterialTags",
"MechanicalEquipment",
"MechanicalEquipmentHiddenLines",
"MechanicalEquipmentTags",
"MEPSpaceColorFill",
"MEPSpaceInteriorFillVisibility",
"MEPSpaceReferenceVisibility",
"MEPSpaces",
"MEPSpaceTags",
"MultiCategoryTags",
"MultiReferenceAnnotations",
"NurseCallDevices",
"NurseCallDeviceTags",
"OverheadLines",
"PanelScheduleGraphics",
"Parking",
"ParkingHiddenLines",
"ParkingTags",
"PartHiddenLines",
"Parts",
"PartTags",
"PathRein",
"PathReinBoundary",
"PathReinSpanSymbol",
"PathReinTags",
"PipeAccessory",
"PipeAccessoryTags",
"PipeColorFillLegends",
"PipeColorFills",
"PipeCurves",
"PipeCurvesCenterLine",
"PipeCurvesDrop",
"PipeCurvesRiseDrop",
"PipeFitting",
"PipeFittingCenterLine",
"PipeFittingTags",
"PipeInsulations",
"PipeInsulationsTags",
"PipeSegments",
"PipeTags",
"PipingSystem",
"PipingSystem_Reference_Visibility",
"PlaceHolderDucts",
"PlaceHolderPipes",
"PlanRegion",
"Planting",
"PlantingHiddenLines",
"PlantingTags",
"PlumbingFixtures",
"PlumbingFixturesHiddenLines",
"PlumbingFixtureTags",
"PointClouds",
"PointLoads",
"PointLoadTags",
"ProjectBasePoint",
"ProjectInformation",
"Purlin",
"RailingHandRail",
"RailingHandRailAboveCut",
"Railings",
"RailingSupport",
"RailingTermination",
"RailingTopRail",
"RailingTopRailAboveCut",
"Ramps",
"RampsAboveCut",
"RampsDownArrow",
"RampsDownText",
"RampsHiddenLines",
"RampsStringer",
"RampsStringerAboveCut",
"RampsUpArrow",
"RampsUpText",
"RasterImages",
"Rebar",
"RebarCover",
"RebarHiddenLines",
"RebarSetToggle",
"RebarShape",
"RebarTags",
"ReferenceLines",
"ReferencePoints",
"ReferencePoints_Lines",
"ReferencePoints_Planes",
"ReferencePoints_Points",
"ReferenceViewer",
"ReferenceViewerSymbol",
"RenderRegions",
"RevisionClouds",
"RevisionCloudTags",
"Roads",
"RoadsHiddenLines",
"Roofs",
"RoofsCutPattern",
"RoofsDefault",
"RoofsFinish2",
"RoofsHiddenLines",
"RoofsInsulation",
"RoofsInteriorEdges",
"RoofsMembrane",
"RoofSoffit",
"RoofsStructure",
"RoofsSubstrate",
"RoofsSurfacePattern",
"RoofTags",
"RoomColorFill",
"RoomInteriorFillVisibility",
"RoomReferenceVisibility",
"Rooms",
"RoomTags",
"RoutingPreferences",
"ScheduleGraphics",
"SecondaryTopographyContours",
"SectionBox",
"SectionHeadMediumLines",
"SectionHeads",
"SectionHeadThinLines",
"SectionHeadWideLines",
"SectionLine",
"Sections",
"SecurityDevices",
"SecurityDeviceTags",
"ShaftOpening",
"ShaftOpeningHiddenLines",
"SharedBasePoint",
"Sheets",
"Site",
"SiteHiddenLines",
"SitePoint",
"SitePointBoundary",
"SiteProperty",
"SitePropertyLineSegmentTags",
"SitePropertyTags",
"SiteTags",
"SketchLines",
"SpanDirectionSymbol",
"SpecialityEquipment",
"SpecialityEquipmentHiddenLines",
"SpecialityEquipmentTags",
"SpotCoordinates",
"SpotElevations",
"SpotElevSymbols",
"SpotSlopes",
"Sprinklers",
"SprinklerTags",
"Stairs",
"StairsDownArrows",
"StairsDownText",
"StairsHiddenLines",
"StairsLandings",
"StairsLandingTags",
"StairsNosingLines",
"StairsNosingLinesAboveCut",
"StairsOutlines",
"StairsOutlinesAboveCut",
"StairsPaths",
"StairsPathsAboveCut",
"StairsRailing",
"StairsRailingAboveCut",
"StairsRailingBaluster",
"StairsRailingHiddenLines",
"StairsRailingRail",
"StairsRailingTags",
"StairsRiserLines",
"StairsRiserLinesAboveCut",
"StairsRuns",
"StairsRunTags",
"StairsSupportsAboveCut",
"StairsTags",
"StairsTrisers",
"StairsUpArrows",
"StairsUpText",
"StructConnectionHiddenLines",
"StructConnections",
"StructConnectionTags",
"StructuralAnnotations",
"StructuralBracePlanReps",
"StructuralColumnLocationLine",
"StructuralColumns",
"StructuralColumnStickSymbols",
"StructuralColumnTags",
"StructuralFoundation",
"StructuralFoundationTags",
"StructuralFraming",
"StructuralFramingLocationLine",
"StructuralFramingOther",
"StructuralFramingSystem",
"StructuralFramingTags",
"StructuralStiffener",
"StructuralStiffenerHiddenLines",
"StructuralStiffenerTags",
"StructuralTruss",
"StructuralTrussStickSymbols",
"SwitchSystem",
"TelephoneDevices",
"TelephoneDeviceTags",
"TextNotes",
"TitleBlockMediumLines",
"TitleBlocks",
"TitleBlockThinLines",
"Topography",
"TopographyContours",
"TopographyHiddenLines",
"TopographySurface",
"TrussChord",
"TrussTags",
"TrussWeb",
"VerticalBracing",
"ViewportLabel",
"Viewports",
"Views",
"VolumeOfInterest",
"WallAnalytical",
"WallAnalyticalTags",
"WallFoundationAnalytical",
"WallFoundationAnalyticalTags",
"WallLocalCoordSys",
"Walls",
"WallsDefault",
"WallsFinish1",
"WallsFinish2",
"WallsInsulation",
"WallsMembrane",
"WallsStructure",
"WallsSubstrate",
"WallsSurfacePattern",
"WallTags",
"WeakDims",
"Windows",
"WindowsFrameMullionProjection",
"WindowsGlassProjection",
"WindowsHiddenLines",
"WindowsOpeningProjection",
"WindowsSillHeadProjection",
"WindowTags",
"Wire",
"WireTags",
"WireTickMarks",
"ZoneTags"];
# ----------------------------------------
byName = Category.ByName(name=code_block)
categories = Output(byName)
names = Output(code_block)
