# Dynamo custom node [&] Curves.Shatter.dyf (Dynamo 2.0.2.6826)
# category: Ampersand.[&] Curve
# Split a collection of curves into smaller curves at each interesection

# note: Colin McCrone
# Twitter:  @ColinMcCrone
# LinkedIn: https://www.linkedin.com/in/colinmccrone
# Updated:  2019-05-20
# An example Dynamo script for how to use this node can be found in the 'extra' folder where the package files are stored. To find it, go to the Packages Menu and select "Manage Packages." Where Ampersand is listed, open the drop-down menu link at the right and choose "Show Root Directory." Open the "extra" folder to find the example file called AmpersandExamples.dyn.
curves = Input(curves: Autodesk.DesignScript.Geometry.Curve[])
intersect = Geometry.Intersect(geometry=curves, other=curves, lacing=CrossProduct)
flatten = List.Flatten(list=intersect@L3)
type = Object.Type(obj=flatten)
code_block = CodeBlock { "Point"; }
contains = String.Contains(str=type, searchFor=code_block)
filterByBoolMask = List.FilterByBoolMask(list=flatten, mask=contains)
code_block_2 = CodeBlock()
# ---------- code_block_2.designscript (2 lines) ----------
// tolerance
0.0001;
# ----------------------------------------
pruneDuplicates = Point.PruneDuplicates(points=filterByBoolMask.in, tolerance=code_block_2)
splitByPoints = Curve.SplitByPoints(curve=curves, points=pruneDuplicates)
flatten_2 = List.Flatten(list=splitByPoints)
curves_2 = Output(flatten_2)  # "curves"
