# Dynamo custom node [&] List.SplitOddEven.dyf (Dynamo 2.0.2.6826)
# category: Ampersand

# note: Colin McCrone
# Twitter:  @ColinMcCrone
# LinkedIn: https://www.linkedin.com/in/colinmccrone
# Updated:  2019-05-20
# An example Dynamo script for how to use this node can be found in the 'extra' folder where the package files are stored. To find it, go to the Packages Menu and select "Manage Packages." Where Ampersand is listed, open the drop-down menu link at the right and choose "Show Root Directory." Open the "extra" folder to find the example file called AmpersandExamples.dyn.
list = Input(list: var[]..[])
code_block = CodeBlock(data=list) { 0..(List.Count(data)-1); }
code_block_2 = CodeBlock { 2; }
mod = code_block % code_block_2
groupByKey = List.GroupByKey(list=list, keys=mod)
code_block_3 = CodeBlock(groups=groupByKey.groups) { odd = groups[0]; even = groups[1]; }
odds = Output(code_block_3.odd)
evens = Output(code_block_3.even)
