# Dynamo custom node [&] List.SublistByRange.dyf (Dynamo 2.0.2.6826)
# category: Ampersand
# Select a sublist by specifying start and end indices, inclusive. If the TO index is smaller than the FROM index, the selection will wrap around to the beginning of the list.

# note: Colin McCrone
# Twitter:  @ColinMcCrone
# LinkedIn: https://www.linkedin.com/in/colinmccrone
# Updated:  2019-05-20
# An example Dynamo script for how to use this node can be found in the 'extra' folder where the package files are stored. To find it, go to the Packages Menu and select "Manage Packages." Where Ampersand is listed, open the drop-down menu link at the right and choose "Show Root Directory." Open the "extra" folder to find the example file called AmpersandExamples.dyn.
list = Input(list: var[]..[])
toIndex = Input(toIndex: var[]..[])
fromIndex = Input(fromIndex: var[]..[])
count = List.Count(list=list)
code_block = CodeBlock(end=toIndex, start=fromIndex, count=count) { max = end + (end < start ? 1 : 0) * count; (start..max) % count; }
getItemAtIndex = List.GetItemAtIndex(list=list, index=code_block.out1)
list_2 = Output(getItemAtIndex)  # "list"
