# Dynamo custom node [&] List.WrappingCouplets.dyf (Dynamo 2.0.2.6826)
# category: Ampersand
# Divide a list into overlapping couplets, connecting the first to the last items.

list = Input(list: var[])
# note: Colin McCrone
# Twitter:  @ColinMcCrone
# LinkedIn: https://www.linkedin.com/in/colinmccrone
# Updated:  2019-05-20
# An example Dynamo script for how to use this node can be found in the 'extra' folder where the package files are stored. To find it, go to the Packages Menu and select "Manage Packages." Where Ampersand is listed, open the drop-down menu link at the right and choose "Show Root Directory." Open the "extra" folder to find the example file called AmpersandExamples.dyn.
firstItem = List.FirstItem(list=list)
addItemToEnd = List.AddItemToEnd(item=firstItem, list=list)
code_block = CodeBlock { 0..1; 1; }
sublists = List.Sublists(list=addItemToEnd, ranges=code_block.out0, offset=code_block.out1)
count = List.Count(list=list)
code_block_2 = CodeBlock(sublists=sublists, num=count) { sublists[0..(num-1)]; }
sublists_2 = Output(code_block_2)  # "sublists"
