# Dynamo custom node [&] Math.ArcAngleFromChordLength.dyf (Dynamo 2.0.2.6826)
# category: Ampersand

# note: Colin McCrone
# Twitter:  @ColinMcCrone
# LinkedIn: https://www.linkedin.com/in/colinmccrone
# Updated:  2019-05-20
# An example Dynamo script for how to use this node can be found in the 'extra' folder where the package files are stored. To find it, go to the Packages Menu and select "Manage Packages." Where Ampersand is listed, open the drop-down menu link at the right and choose "Show Root Directory." Open the "extra" folder to find the example file called AmpersandExamples.dyn.
chordLength = Input(chordLength: double)
radius = Input(radius: double)
code_block = CodeBlock(chord=chordLength, radius=radius) { 2 * Math.Asin(chord/(2*radius)); }
angle = Output(code_block)
