# Dynamo custom node [&] Math.ArcLengthFromAngle.dyf (Dynamo 2.0.2.6826)
# category: Ampersand

radius = Input(radius: var[]..[])
# note: Colin McCrone
# Twitter:  @ColinMcCrone
# LinkedIn: https://www.linkedin.com/in/colinmccrone
# Updated:  2019-05-20
# An example Dynamo script for how to use this node can be found in the 'extra' folder where the package files are stored. To find it, go to the Packages Menu and select "Manage Packages." Where Ampersand is listed, open the drop-down menu link at the right and choose "Show Root Directory." Open the "extra" folder to find the example file called AmpersandExamples.dyn.
angle = Input(angle: var[]..[])
code_block = CodeBlock(radius=radius, angle=angle) { radius * Math.DegreesToRadians(angle); }
arcLength = Output(code_block)
