# Dynamo custom node [&] Math.ArcLengthFromChordLength.dyf (Dynamo 2.0.2.6826)
# category: Ampersand

code_block = CodeBlock()
# ---------- code_block.designscript (13 lines) ----------
// Find the curve length between the end points of a chord
//
// Colin McCrone
// Twitter:  https://twitter.com/colinmccrone
// LinkedIn: https://www.linkedin.com/in/colinmccrone
// Updated:  2019-05-20
//
def ArcChord2ArcLength(chord:double, radius:double)
{
	deg = Math.Asin(chord/(2*radius));
	radians = Math.DegreesToRadians(deg);
	return = 2*radius*radians;
};
# ----------------------------------------
# note: Colin McCrone
# Twitter:  @ColinMcCrone
# LinkedIn: https://www.linkedin.com/in/colinmccrone
# Updated:  2019-05-20
# An example Dynamo script for how to use this node can be found in the 'extra' folder where the package files are stored. To find it, go to the Packages Menu and select "Manage Packages." Where Ampersand is listed, open the drop-down menu link at the right and choose "Show Root Directory." Open the "extra" folder to find the example file called AmpersandExamples.dyn.
chordLength = Input(chordLength: var[]..[])
radius = Input(radius: var[]..[])
code_block_2 = CodeBlock(chord=chordLength, radius=radius) { ArcChord2ArcLength(chord, radius); }
arcLength = Output(code_block_2)
