# Dynamo custom node [&] Math.PartialSums.dyf (Dynamo 2.0.2.6826)
# category: Ampersand
# Find the sum of a set of numbers and a list of the partial sums.

# note: Colin McCrone
# Twitter:  @ColinMcCrone
# LinkedIn: https://www.linkedin.com/in/colinmccrone
# Updated:  2019-05-20
# An example Dynamo script for how to use this node can be found in the 'extra' folder where the package files are stored. To find it, go to the Packages Menu and select "Manage Packages." Where Ampersand is listed, open the drop-down menu link at the right and choose "Show Root Directory." Open the "extra" folder to find the example file called AmpersandExamples.dyn.
numbers = Input(numbers: var[]..[])
sum = Math.Sum(values=numbers)
sum_2 = Output(sum)  # "sum"
code_block = CodeBlock(n=numbers) { PartialSums(n); }
partialSums = Output(code_block)
code_block_2 = CodeBlock()
# ---------- code_block_2.designscript (28 lines) ----------
// Create a list of partials sums
// or the sum at each index of all
// previous values.
//
// Colin McCrone
// Twitter:  https://twitter.com/colinmccrone
// LinkedIn: https://www.linkedin.com/in/colinmccrone
// Updated:  2019-05-20
//
def PartialSums(nums:var[])
{
	ct = List.Count(nums);

	return = [Imperative]
	{
		sum = 0;
		ps = 0..#ct..0;
		i = 0;
		while(i < ct)
		{
			sum = sum + nums[i];
			ps[i] = sum;
			i = i+1;
		}

		return = ps;
	}
};
# ----------------------------------------
