# Dynamo custom node [&] Misc.Car.dyf (Dynamo 2.0.1.5055)
# category: Ampersand
# Car

code_block = CodeBlock()  # unwired: deleteMe
# ---------- code_block.designscript (2 lines) ----------
[65,67,73,83,32,66,105,110,97,114,121,70,105,108,101,188,2,0,0,0,
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97
];
# ----------------------------------------
deserializeFromSAB = Geometry.DeserializeFromSAB(buffer=code_block)
namev1 = Output(deserializeFromSAB)
