# Dynamo custom node [&] PointGrid.ToDiagrid.dyf (Dynamo 2.0.2.6826)
# category: Ampersand.[&] Point
# Create a diagrid point patterns from a rectangular grid of points.  Change the switchSet Boolean value to swith which set of checker-board points is selected.

# note: Colin McCrone
# Twitter:  @ColinMcCrone
# LinkedIn: https://www.linkedin.com/in/colinmccrone
# Updated:  2019-05-20
# An example Dynamo script for how to use this node can be found in the 'extra' folder where the package files are stored. To find it, go to the Packages Menu and select "Manage Packages." Where Ampersand is listed, open the drop-down menu link at the right and choose "Show Root Directory." Open the "extra" folder to find the example file called AmpersandExamples.dyn.
pointGrid = Input(pointGrid: Autodesk.DesignScript.Geometry.Point[]..[])
code_block = CodeBlock { 2; }
switchSet = Input(switchSet: bool = false)
count = List.Count(list=pointGrid)
code_block_2 = CodeBlock(n=count) { (1..n)%2; (0..(n-1))%2; }
if_ = If(test=switchSet, true=code_block_2.out0, false=code_block_2.out1)
takeEveryNthItem = List.TakeEveryNthItem(list=pointGrid@L2, n=code_block, offset=if_@L1)
pointGrid_2 = Output(takeEveryNthItem)  # "pointGrid"
