# Dynamo custom node [&] PointList.IsCollinear.dyf (Dynamo 2.0.2.6826)
# category: Ampersand.[&] Point
# Whether a set of points is collinear.

# note: Colin McCrone
# Twitter:  @ColinMcCrone
# LinkedIn: https://www.linkedin.com/in/colinmccrone
# Updated:  2019-05-20
# An example Dynamo script for how to use this node can be found in the 'extra' folder where the package files are stored. To find it, go to the Packages Menu and select "Manage Packages." Where Ampersand is listed, open the drop-down menu link at the right and choose "Show Root Directory." Open the "extra" folder to find the example file called AmpersandExamples.dyn.
points = Input(points: Autodesk.DesignScript.Geometry.Point[])
deconstruct = List.Deconstruct(list=points)
byTwoPoints = Vector.ByTwoPoints(start=deconstruct.first, end=deconstruct.rest)
deconstruct_2 = List.Deconstruct(list=byTwoPoints)
cross = Vector.Cross(vector=deconstruct_2.first, cross=deconstruct_2.rest)
length = Vector.Length(vector=cross)
code_block = CodeBlock { 0.00001; }
lt = length < code_block
allTrue = List.AllTrue(list=lt)
bool = Output(allTrue)
