# Dynamo custom node [&] PointList.SortAzimuthally.dyf (Dynamo 2.0.2.6826)
# category: Ampersand.[&] Point
# Sort points azimuthally (like sorting numbers around a clock face) in a plane.  Points are ordered about the origin of the plane, proceeding from the positive x-axis of the plane in a counter-clockwise direction about the plane normal vector.

# note: Colin McCrone
# Twitter:  @ColinMcCrone
# LinkedIn: https://www.linkedin.com/in/colinmccrone
# Updated:  2019-05-20
# An example Dynamo script for how to use this node can be found in the 'extra' folder where the package files are stored. To find it, go to the Packages Menu and select "Manage Packages." Where Ampersand is listed, open the drop-down menu link at the right and choose "Show Root Directory." Open the "extra" folder to find the example file called AmpersandExamples.dyn.
points = Input(points: Autodesk.DesignScript.Geometry.Point[])
plane = Input(plane: Autodesk.DesignScript.Geometry.Plane = Autodesk.DesignScript.Geometry.Plane.XY())
origin = Plane.Origin(plane=plane)
byTwoPoints = Vector.ByTwoPoints(start=origin, end=points)
normalized = Vector.Normalized(vector=byTwoPoints)
vector_projecttoplane = Custom[[&] Vector.ProjectToPlane](vector=normalized, plane=plane)  # Find the projection of the vector to the specified plane.
XAxis = Plane.XAxis(plane=plane)
cross = Vector.Cross(vector=vector_projecttoplane, cross=XAxis)
normal = Plane.Normal(plane=plane)
dot = Vector.Dot(vector=cross, vec=normal)
code_block = CodeBlock { 0; }
gt = dot > code_block
dot_2 = Vector.Dot(vector=vector_projecttoplane, vec=XAxis)
acos = Math.Acos(ratio=dot_2)
code_block_2 = CodeBlock(reverse=gt, theta=acos) { reverse?(360-theta):theta; }
sortByKey = List.SortByKey(list=points, keys=code_block_2)
points_2 = Output(sortByKey.sorted_list)  # "points"
angles = Output(sortByKey.sorted_keys)
