# Dynamo custom node [&] PointList.VisualizePanels.dyf (Dynamo 2.0.2.6826)
# category: Ampersand.[&] Point

# note: Colin McCrone
# Twitter:  @ColinMcCrone
# LinkedIn: https://www.linkedin.com/in/colinmccrone
# Updated:  2019-05-20
# An example Dynamo script for how to use this node can be found in the 'extra' folder where the package files are stored. To find it, go to the Packages Menu and select "Manage Packages." Where Ampersand is listed, open the drop-down menu link at the right and choose "Show Root Directory." Open the "extra" folder to find the example file called AmpersandExamples.dyn.
vertices = Input(vertices: Autodesk.DesignScript.Geometry.Point[][])
code_block = CodeBlock { true; }
byPoints = PolyCurve.ByPoints(points=vertices, connectLastToFirst=code_block)
byPatch = Surface.ByPatch(closedCurve=byPoints)
flatten = List.Flatten(list=byPatch)
shuffle = List.Shuffle(list=flatten)
count = List.Count(list=flatten)
code_block_2 = CodeBlock(count=count) { 0..1..#count; }
color_range = ColorRange(value=code_block_2)  # unwired: colors, indices
byGeometryColor = Modifiers.GeometryColor.ByGeometryColor(geometry=shuffle, color=color_range)
Display = Output(byGeometryColor)
