# Dynamo custom node [&] PolyCurve.ConvexHull.dyf (Dynamo 2.3.0.5885)
# category: Ampersand.[&] Curve
# Find the convex hull for a planar polycurve

# note: Colin McCrone
# Twitter:  @ColinMcCrone
# LinkedIn: https://www.linkedin.com/in/colinmccrone
# Updated:  2019-12-30
# An example Dynamo script for how to use this node can be found in the 'extra' folder where the package files are stored. To find it, go to the Packages Menu and select "Manage Packages." Where Ampersand is listed, open the drop-down menu link at the right and choose "Show Root Directory." Open the "extra" folder to find the example file called AmpersandExamples.dyn.
polyCurve = Input(polyCurve: Autodesk.DesignScript.Geometry.PolyCurve)
code_block = CodeBlock(pcrv=polyCurve) { FindConvexHull(pcrv); }
polyCurve_2 = Output(code_block)  # "polyCurve"
code_block_2 = CodeBlock()
# ---------- code_block_2.designscript (39 lines) ----------
// Iteratively call a function to identify convex
// vertices of a closed polycurve. Stop when no
// further concave or straight vertices have been
// identified and culled.
//
// Colin McCrone
// Twitter:  https://twitter.com/colinmccrone
// LinkedIn: https://www.linkedin.com/in/colinmccrone
// Updated:  2019-05-20
//
def FindConvexHull(pCrv:var)
{
	numVerts = 10;
	count = DSCore.List.Count;
	return = [Imperative]
	{
		s1=null;
		isHull = false;
		verts=null;
		i = 0;
		while(!isHull && i < numVerts)
		{
			// Get convex vertices
			s1 = ConvexVertices(pCrv);
			isHull = s1[0];
			verts = s1[1];
			numVerts = count(verts);

			// Make a polycurve
			pCrv = PolyCurve.ByPoints(verts,true);

			// Update counter
			i = i+1;
		}

		return = pCrv;
	}

};
# ----------------------------------------
code_block_3 = CodeBlock()
# ---------- code_block_3.designscript (61 lines) ----------
// Find the winding vector of the direction of the closed polycurve
// and compare the normalized cross product at each vertex to the
// winding vector. Those aligned vectors indicate a convex vertex.
//
// Colin McCrone
// Twitter:  https://twitter.com/colinmccrone
// LinkedIn: https://www.linkedin.com/in/colinmccrone
// Updated:  2019-12-30
//
def ConvexVertices(pCrv:PolyCurve)
{
	// All vertices
	crvs = pCrv.Explode();
	vertices = crvs.PointAtParameter(0);

	// Normal of the best-fit plane through vertices;
	// not necessarily aligned with winding direction of pCrv
	plane1 = Plane.ByBestFitThroughPoints(vertices);
	normal = plane1.Normal;

	// Cross products at each vertex in the order of the
	// curve segments
	shifted = List.ShiftIndices(crvs, 1);
	vec1 = shifted.TangentAtParameter(1);
	vec2 = crvs.TangentAtParameter(0);
	crossProd = vec1.Cross(vec2);

	// Inside angle at each vertex
	// A x B = ABsinTheta
	ratio = crossProd.Length;
	inAng = Math.Asin(ratio>1.0 ? 1.0 : ratio);

	// Direction of the vertex cross product compared to
	// the plane normal
	crossMag = crossProd.Dot(normal);
	crossSign = Math.Sign(crossMag);

	// Weighted outside angle at each vertex
	outAng = crossSign * (180 - inAng);

	// Sum of the weighted outside angles: either 180 or -180
	sumOutAng = Math.Sum(outAng);

	// Winding Vector is either the original vector or the reverse
	direction = Math.Sign(sumOutAng);
	windVec = normal.Scale(direction);

	// Compare normalized cross products at each vertex to winding
	// vector. Those that are aligned indicate convex vertices
	normCrossProd = crossProd.Normalized();
	alignment = windVec.Dot(normCrossProd);
	isConvex = alignment > 0.001;
	isAllConvex = DSCore.List.AllTrue(isConvex);

	// Identify convex vertex points
	t1 = List.FilterByBoolMask(vertices, isConvex);
	convexPts = t1["in"];

	// Return
	return = [isAllConvex,convexPts];
};
# ----------------------------------------
