# Dynamo custom node [&] PolyCurve.IsClockwise.dyf (Dynamo 2.0.2.6826)
# category: Ampersand.[&] Curve
# For closed polycurves with reasonably straight segments, return true if the curve is clockwise relative to the plane, false otherwise.

# note: Colin McCrone
# Twitter:  @ColinMcCrone
# LinkedIn: https://www.linkedin.com/in/colinmccrone
# Updated:  2019-05-20
# An example Dynamo script for how to use this node can be found in the 'extra' folder where the package files are stored. To find it, go to the Packages Menu and select "Manage Packages." Where Ampersand is listed, open the drop-down menu link at the right and choose "Show Root Directory." Open the "extra" folder to find the example file called AmpersandExamples.dyn.
polycurve = Input(polycurve: Autodesk.DesignScript.Geometry.PolyCurve)
polycurve_windingvector = Custom[[&] PolyCurve.WindingVector](polyCurve=polycurve)  # Find the winding vector of the direction of the vertices of a closed PolyCurve. Find the normal of a plane by best fit through points, then sum the outside angles for each vertex to see whether the winding angle aligns with or is the negative of the assumed plane normal vector. Return the plane normal vector aligned with the winding direction of the PolyCurve's vertices.
plane = Input(plane: Autodesk.DesignScript.Geometry.Plane = Autodesk.DesignScript.Geometry.Plane.XY())
normal = Plane.Normal(plane=plane)
dot = Vector.Dot(vector=polycurve_windingvector, vec=normal)
code_block = CodeBlock(dot=dot) { dot < 0; }
bool = Output(code_block)
