# Dynamo custom node [&] PolyCurve.MinBoundingBox.dyf (Dynamo 2.0.2.6826)
# category: Ampersand.[&] Curve
# For a planar PolyCurve, find the minimum rectangular bounding box in its plane.

# note: Algorithm informed by:
# https://en.wikipedia.org/wiki/Rotating_calipers
# note: Colin McCrone
# Twitter:  @ColinMcCrone
# LinkedIn: https://www.linkedin.com/in/colinmccrone
# Updated:  2019-05-20
# An example Dynamo script for how to use this node can be found in the 'extra' folder where the package files are stored. To find it, go to the Packages Menu and select "Manage Packages." Where Ampersand is listed, open the drop-down menu link at the right and choose "Show Root Directory." Open the "extra" folder to find the example file called AmpersandExamples.dyn.
polyCurve = Input(polyCurve: Autodesk.DesignScript.Geometry.PolyCurve)

# group: Points describing a convex hull
polycurve_convexhull = Custom[[&] PolyCurve.ConvexHull](polyCurve=polyCurve)  # Find the convex hull for a planar polycurve
curves = PolyCurve.Curves(polyCurve=polycurve_convexhull)
pointAtParameter = Curve.PointAtParameter(curve=curves)

# note: Matrix of vectors between every pair
# (self included on the diagonal)
byTwoPoints = Vector.ByTwoPoints(start=pointAtParameter, end=pointAtParameter, lacing=CrossProduct)
count = List.Count(list=byTwoPoints)
code_block = CodeBlock(ct=count) { (1..ct)%ct; }
# note: Vector per side
# Ordered by base point
getItemAtIndex = List.GetItemAtIndex(list=byTwoPoints@L2, index=code_block@L1)
# note: Parallel vector to each side
normalized = Vector.Normalized(vector=getItemAtIndex)
dot = Vector.Dot(vector=normalized, vec=byTwoPoints)
# note: Projection of the vector between each base point and every other point onto the parallel direction.
scale = Vector.Scale(vector=normalized, scale_factor=dot)
# note: Vectors sorted by their lengths
sortByKey = List.SortByKey(list=scale@L2, keys=dot@L2)
lastItem = List.LastItem(list=sortByKey.sorted_keys@L2)
firstItem = List.FirstItem(list=sortByKey.sorted_keys@L2)
# note: Length of parallel Bounding Box sde
sub = lastItem - firstItem
polycurve_windingvector = Custom[[&] PolyCurve.WindingVector](polyCurve=polycurve_convexhull)  # Find the winding vector of the direction of the vertices of a closed PolyCurve. Find the normal of a plane by best fit through points, then sum the outside angles for each vertex to see whether the winding angle aligns with or is the negative of the assumed plane normal vector. Return the plane normal vector aligned with the winding direction of the PolyCurve's vertices.
code_block_2 = CodeBlock { 90; }
# note: Perpendicular vector from each side oriented inward
rotate = Vector.Rotate(vector=normalized, axis=polycurve_windingvector, degrees=code_block_2)
dot_2 = Vector.Dot(vector=rotate, vec=byTwoPoints)
# note: Projection of the vector between each base point and every other point onto the perpendicular direction.
scale_2 = Vector.Scale(vector=rotate, scale_factor=dot_2)
sortByKey_2 = List.SortByKey(list=scale_2@L2, keys=dot_2@L2)
# note: Longest perpendicular vector per base point.
# ** First Axis **
lastItem_2 = List.LastItem(list=sortByKey_2.sorted_list@L2)
# note: Length of perpendicular Bounding Box side
length = Vector.Length(vector=lastItem_2)
# note: Area of each possible Bounding Box
mul = sub * length
minimumItem = List.MinimumItem(list=mul)
# note: Index of smallest bounding box
indexOf = List.IndexOf(list=mul, element=minimumItem)
getItemAtIndex_2 = List.GetItemAtIndex(list=pointAtParameter, index=indexOf)
firstItem_2 = List.FirstItem(list=sortByKey.sorted_list@L2)
getItemAtIndex_3 = List.GetItemAtIndex(list=firstItem_2, index=indexOf)
# note: Corner Point 1
add = Point.Add(point=getItemAtIndex_2, vectorToAdd=getItemAtIndex_3)
lastItem_3 = List.LastItem(list=sortByKey.sorted_list@L2)
getItemAtIndex_4 = List.GetItemAtIndex(list=lastItem_3, index=indexOf)
# note: Corner Point 2
add_2 = Point.Add(point=getItemAtIndex_2, vectorToAdd=getItemAtIndex_4)
getItemAtIndex_5 = List.GetItemAtIndex(list=lastItem_2, index=indexOf)
# note: Corner Point 3
add_3 = Point.Add(point=add_2, vectorToAdd=getItemAtIndex_5)
# note: Corner Point 4
add_4 = Point.Add(point=add, vectorToAdd=getItemAtIndex_5)
create = List.Create(item0=add, item1=add_2, item2=add_3, item3=add_4)
byTwoPoints_2 = Vector.ByTwoPoints(start=add, end=add_2)
# note: [0] Parallel Axis Vector
# [1] Perpendicular Axis Vector
create_2 = List.Create(item0=byTwoPoints_2, item1=getItemAtIndex_5)
length_2 = Vector.Length(vector=create_2)
sortByKey_3 = List.SortByKey(list=create_2, keys=length_2)
code_block_3 = CodeBlock(lens=sortByKey_3.sorted_keys) { lens[1]; }
# note: Index of the longest axis, 0 or 1
indexOf_2 = List.IndexOf(list=length_2, element=code_block_3)
# note: To make the first edge always the longest edge, shift the verticies by one if the first edge is the shortest edge.
shiftIndices = List.ShiftIndices(list=create, amount=indexOf_2)
code_block_4 = CodeBlock(pts=shiftIndices) { pts[0]; pts[1]; pts[2]; pts[3]; }
byCornerPoints = Rectangle.ByCornerPoints(p1=code_block_4.out0, p2=code_block_4.out1, p3=code_block_4.out2, p4=code_block_4.out3)
rectangle = Output(byCornerPoints)
cornerPoints = Output(shiftIndices)  # "cornerPoints[]"
byTwoPoints_3 = Vector.ByTwoPoints(start=code_block_4.out0, end=code_block_4.out1)
longAxis = Output(byTwoPoints_3)
byTwoPoints_4 = Vector.ByTwoPoints(start=code_block_4.out0, end=code_block_4.out3)
shortAxis = Output(byTwoPoints_4)
area = Output(minimumItem)
