# Dynamo custom node [&] PolyCurve.Vertices.dyf (Dynamo 2.0.2.6826)
# category: Ampersand.[&] Curve
# Find the points at vertices for a closed polycurve and indicates whether the vertices are concave (-1), straight (0), or convex (+1).

# note: Colin McCrone
# Twitter:  @ColinMcCrone
# LinkedIn: https://www.linkedin.com/in/colinmccrone
# Updated:  2019-05-20
# An example Dynamo script for how to use this node can be found in the 'extra' folder where the package files are stored. To find it, go to the Packages Menu and select "Manage Packages." Where Ampersand is listed, open the drop-down menu link at the right and choose "Show Root Directory." Open the "extra" folder to find the example file called AmpersandExamples.dyn.
polyCurve = Input(polyCurve: Autodesk.DesignScript.Geometry.PolyCurve)
explode = Geometry.Explode(geometry=polyCurve)
pointAtParameter = Curve.PointAtParameter(curve=explode)
points = Output(pointAtParameter)
polycurve_windingvector = Custom[[&] PolyCurve.WindingVector](polyCurve=polyCurve)  # Find the winding vector of the direction of the vertices of a closed PolyCurve. Find the normal of a plane by best fit through points, then sum the outside angles for each vertex to see whether the winding angle aligns with or is the negative of the assumed plane normal vector. Return the plane normal vector aligned with the winding direction of the PolyCurve's vertices.
code_block = CodeBlock { 1; }
shiftIndices = List.ShiftIndices(list=explode, amount=code_block)
code_block_2 = CodeBlock { 1; 0; }
tangentAtParameter = Curve.TangentAtParameter(curve=shiftIndices, param=code_block_2.out0)
tangentAtParameter_2 = Curve.TangentAtParameter(curve=explode, param=code_block_2.out1)
# note: cross products at vertices
cross = Vector.Cross(vector=tangentAtParameter, cross=tangentAtParameter_2)
normalized = Vector.Normalized(vector=cross)
# note: Compare to winding vector
dot = Vector.Dot(vector=polycurve_windingvector, vec=normalized)
code_block_3 = CodeBlock(dot=dot) { tol = 0.0001; dot > tol; dot < -tol; }
isConvex = Output(code_block_3.out1)
isConcave = Output(code_block_3.out2)
code_block_4 = CodeBlock(convex=code_block_3.out1, concave=code_block_3.out2) { !convex && !concave; }
isStraight = Output(code_block_4)
