# Dynamo custom node [&] PolyCurve.WindingVector.dyf (Dynamo 2.3.0.5885)
# category: Ampersand.[&] Curve
# Find the winding vector of the direction of the vertices of a closed PolyCurve. Find the normal of a plane by best fit through points, then sum the outside angles for each vertex to see whether the winding angle aligns with or is the negative of the assumed plane normal vector. Return the plane normal vector aligned with the winding direction of the PolyCurve's vertices.

code_block = CodeBlock()
# ---------- code_block.designscript (54 lines) ----------
// Find the winding vector of the direction of the vertices
// of a closed PolyCurve. Find the normal of a plane by best
// fit through points, then sum the outside angles for each
// vertex to see whether the winding angle aligns with or is
// the negative of the assumed plane normal vector. Return the
// plane normal vector aligned with the winding direction of
// the PolyCurve's vertices.
//
// Colin McCrone
// Twitter:  https://twitter.com/colinmccrone
// LinkedIn: https://www.linkedin.com/in/colinmccrone
// Updated:  2019-12-30
//
def WindingVector(pCrv:PolyCurve)
{
	// All vertices
	crvs = pCrv.Explode();
	vertices = crvs.PointAtParameter(0);

	// Normal of the best-fit plane through vertices, not
	// necessarily aligned with winding direction of pCrv
	plane1 = Plane.ByBestFitThroughPoints(vertices);
	normal = plane1.Normal;

	// Cross products at each vertex in the order of the
	// curve segments
	shifted = List.ShiftIndices(crvs, 1);
	vec1 = shifted.TangentAtParameter(1);
	vec2 = crvs.TangentAtParameter(0);
	crossProd = vec1.Cross(vec2);

	// Inside angle at each vertex
	// A x B = ABsinTheta
	ratio = crossProd.Length;
	inAng = Math.Asin(ratio>1.0 ? 1.0 : ratio);

	// Direction of the vertex cross product compared to
	// the plane normal
	crossMag = crossProd.Dot(normal);
	crossSign = Math.Sign(crossMag);

	// Weighted outside angle at each vertex
	outAng = crossSign * (180 - inAng);

	// Sum of the weighted outside angles: either 180 or -180
	sumOutAng = Math.Sum(outAng);

	// Winding Vector is either the original vector or the reverse
	direction = Math.Sign(sumOutAng);
	windVec = normal.Scale(direction);

	// Return
	return = windVec;
};
# ----------------------------------------
# note: Colin McCrone
# Twitter:  @ColinMcCrone
# LinkedIn: https://www.linkedin.com/in/colinmccrone
# Updated:  2019-12-30
# An example Dynamo script for how to use this node can be found in the 'extra' folder where the package files are stored. To find it, go to the Packages Menu and select "Manage Packages." Where Ampersand is listed, open the drop-down menu link at the right and choose "Show Root Directory." Open the "extra" folder to find the example file called AmpersandExamples.dyn.
polyCurve = Input(polyCurve: var[]..[])
code_block_2 = CodeBlock(pcrv=polyCurve) { WindingVector(pcrv); }
vector = Output(code_block_2)
