# Dynamo custom node [&] Vector.ByAltitudeAzimuth.dyf (Dynamo 2.0.2.6826)
# category: Ampersand
# Create a unit vector by its altitude and azimuth.  The positive Y axis is taken as north and the positive Z axis is taken as up.
# Altitudinal convention is:
# 90° = straight up (+Z axis),
# 0° = horizontal,
# -90° = straight down (-Z axis).
# Azimuthal convention is:
# 0° = North (+Y axis),
# 90° = East (+X axis),
# 180° = South (-Y axis),
# 270° = West (-X axis).

# note: Colin McCrone
# Twitter:  @ColinMcCrone
# LinkedIn: https://www.linkedin.com/in/colinmccrone
# Updated:  2019-05-20
# An example Dynamo script for how to use this node can be found in the 'extra' folder where the package files are stored. To find it, go to the Packages Menu and select "Manage Packages." Where Ampersand is listed, open the drop-down menu link at the right and choose "Show Root Directory." Open the "extra" folder to find the example file called AmpersandExamples.dyn.
altitude = Input(altitude: var[]..[])
azimuth = Input(azimuth: var[]..[])
# note: Create a unit vector by its altitude and azimuth.  The positive Y axis is taken as north and the positive Z axis is taken as up.
# Altitudinal convention is:
# 90° = straight up (+Z axis),
# 0° = horizontal,
# -90° = straight down (-Z axis).
# Azimuthal convention is:
# 0° = North (+Y axis),
# 90° = East (+X axis),
# 180° = South (-Y axis),
# 270° = West (-X axis).
code_block = CodeBlock(altitude=altitude, azimuth=azimuth)
# ---------- code_block.designscript (7 lines) ----------
// altitude=0 is perfectly horizontal
//translated to angle from +Z axis
phi = 90 - altitude;

// azimuth=0 is North (+Y axis)
// translated to CCW from +X axis
theta = (90 - azimuth) % 360;
# ----------------------------------------
sin = Math.Sin(angle=code_block.phi)
cos = Math.Cos(angle=code_block.theta)
sin_2 = Math.Sin(angle=code_block.theta)
cos_2 = Math.Cos(angle=code_block.phi)
code_block_2 = CodeBlock(sinPhi=sin, cosTheta=cos, sinTheta=sin_2, cosPhi=cos_2) { sinPhi * cosTheta; sinTheta * sinPhi; cosPhi; true; }
byCoordinates = Vector.ByCoordinates(x=code_block_2.out0, y=code_block_2.out1, z=code_block_2.cosPhi, normalized=code_block_2.out3)
vector = Output(byCoordinates)
