# Dynamo custom node [&] Vector.ProjectToPlane.dyf (Dynamo 2.0.2.6826)
# category: Ampersand
# Find the projection of the vector to the specified plane.

# note: Colin McCrone
# Twitter:  @ColinMcCrone
# LinkedIn: https://www.linkedin.com/in/colinmccrone
# Updated:  2019-05-20
# An example Dynamo script for how to use this node can be found in the 'extra' folder where the package files are stored. To find it, go to the Packages Menu and select "Manage Packages." Where Ampersand is listed, open the drop-down menu link at the right and choose "Show Root Directory." Open the "extra" folder to find the example file called AmpersandExamples.dyn.
vector = Input(vector: Autodesk.DesignScript.Geometry.Vector)
plane = Input(plane: Autodesk.DesignScript.Geometry.Plane = Autodesk.DesignScript.Geometry.Plane.XY())
normal = Plane.Normal(plane=plane)
dot = Vector.Dot(vector=vector, vec=normal)
# note: Component of the vector
# perpendicular to the plane.
scale = Vector.Scale(vector=normal, scale_factor=dot)
# note: Component of the vector
# parallel to the plane.
subtract = Vector.Subtract(vector=vector, vectorToSubtract=scale)
vector_2 = Output(subtract)  # "vector"
