# Dynamo custom node Utils.ApproximateCurvesWithLines.dyf (Dynamo 2.1.0.7500)
# category: SpaceAnalysis
# Approximate Curves With Lines

curves = Input(curves: var[]..[])  # List of Curves (Lines, Circles, Ellipse, Arcs, Nurbs, etc.)
code_block = CodeBlock(geom=curves) { geom; }

# group: Filter Out Lines
string_from_object = FromObject(obj=code_block)
code_block_2 = CodeBlock { "Line"; }
contains = String.Contains(str=string_from_object, searchFor=code_block_2)
filterByBoolMask = List.FilterByBoolMask(list=code_block, mask=contains)

segmentLength = Input(segmentLength: var = 0.5)  # Segment Length to sample Curves
code_block_3 = CodeBlock(segmentLength=segmentLength) { segmentLength; }

# group: Filter Out Circles (Can use Polygon.RegularPolygon to get lines)
string_from_object_2 = FromObject(obj=filterByBoolMask.out)
code_block_4 = CodeBlock { "Circle"; }
contains_2 = String.Contains(str=string_from_object_2, searchFor=code_block_4)
filterByBoolMask_2 = List.FilterByBoolMask(list=filterByBoolMask.out, mask=contains_2)
code_block_5 = CodeBlock { false; }
clean = List.Clean(list=filterByBoolMask_2.in, preserveIndices=code_block_5)
code_block_6 = CodeBlock(curve=clean, segLenght=code_block_3) { segments = Math.Max(5, Math.Floor((Autodesk.Curve.Length(curve)) / segLenght)); }
regularPolygon = Polygon.RegularPolygon(circle=clean, numberSides=code_block_6)
explode = Geometry.Explode(geometry=regularPolygon)

# group: Filter Out Rectangle
string_from_object_3 = FromObject(obj=filterByBoolMask_2.out)
code_block_7 = CodeBlock { "Rectangle"; }
contains_3 = String.Contains(str=string_from_object_3, searchFor=code_block_7)
filterByBoolMask_3 = List.FilterByBoolMask(list=filterByBoolMask_2.out, mask=contains_3)
code_block_8 = CodeBlock { false; }
clean_2 = List.Clean(list=filterByBoolMask_3.in, preserveIndices=code_block_8)
explode_2 = Geometry.Explode(geometry=clean_2)

# group: Resample All other curves
code_block_9 = CodeBlock(curve=filterByBoolMask_3.out, segLenght=code_block_3) { segments = Math.Max(2, Math.Floor((Autodesk.Curve.Length(curve)) / segLenght)); seq = (0..1..#segments); }
pointAtParameter = Curve.PointAtParameter(curve=filterByBoolMask_3.out, param=code_block_9.seq)
byPoints = PolyCurve.ByPoints(points=pointAtParameter)
curves_2 = PolyCurve.Curves(polyCurve=byPoints)

list_create = List.Create(item0=explode, item1=curves_2, item2=explode_2)
code_block_10 = CodeBlock(c=list_create)
# ---------- code_block_10.designscript (4 lines) ----------
curves = List.Flatten(c, -1);
Line.ByStartPointEndPoint(
Autodesk.Curve.StartPoint(curves),
Autodesk.Curve.EndPoint(curves));
# ----------------------------------------
code_block_11 = CodeBlock(lines=filterByBoolMask.in, lines2=code_block_10.out1) { List.Clean(List.Flatten([lines,lines2], -1), false); }
lines = Output(code_block_11)
