# Dynamo graph Workspace Layout.dyn (Dynamo 2.5.0.7186)
# packages: Clockwork for Dynamo 2.x 2.1.2, GenerativeDesign 0.75.1, SpaceAnalysis 0.3.3, Ampersand 2019.12.31

# note: Variables / Inputs
# Variables that can be altered per project and must be set accordingly before running the script.
# note: Metrics / Goals / Outputs
# Logic associated with calculating goals, metrics, outputs .
# note: Working / Functions
# Core working of the script.
# note: Display / Visualization
# Logic used simply for visualization purposes, and doesn't contain core logic.
# note: Remember Nodes
# Data that needs to be cached from D4R is stored here.

# group: Workspace Layout
# note: DYNAMO PROJECT
# Workspace Layout.dyn
# note: ASSOCIATED FILE(S)
# N/A
# note: AUTHOR(S) / CREATION DATE
# Autodesk AEC Generative Design Group / 2020
# note: DESCRIPTION
# This example is designed to use Generative Design optimization to find efficient desk layouts given a selected Revit room element and a selected Revit desk family instance. The Space Analysis package is used to score each desk with respect to window views, and distance to exits. These scores are then averaged for the layout so design options can be optimized and compared using Generative Design.
# note: DYNAMO VERSION
# 2.5.0
# note: ADDITIONAL COMMENTS
# N/A
# note: REQUIRED DYNAMO PACKAGES
# SpaceAnalysis 0.3.3
# GenerativeDesign 1.0+
# Clockwork 2.0+
# Ampersand 2019.12.31

# group: Place Desks in Revit
# note: Send to Revit

# group: Calculate Room Properties
# note: Extract and Process Room Geometry from Revit

# group: Space Planning Metrics and Analytics
# note: Space Planning Metrics and Analytics

# group: Desk Placement
# note: Desk Placement

# group: Calculate Selected Desk Properties
# note: Desk Properties

# group: INPUT Room
select_a_room = DSModelRoomSelection()  # nothing selected; graph input

# group: Level of selected Room
level = Custom[Element.Level](element=select_a_room)  # package Clockwork for Dynamo 2.x; Gets an element's level
name = Level.Name(level=level)

# group: Room outlines
coreBoundary = Room.CoreBoundary(room=select_a_room)
byJoinedCurves = PolyCurve.ByJoinedCurves(curves=coreBoundary)
# note: The longest room outline is the room itself; any smaller outlines correspond to columns.
length = Curve.Length(curve=byJoinedCurves)
sortByKey = List.SortByKey(list=byJoinedCurves, keys=length)
lastItem = List.LastItem(list=sortByKey.sorted_list)
code_block = CodeBlock(roomPCrv=lastItem) { roomPCrv; }
byJoinedCurves_2 = PolyCurve.ByJoinedCurves()  # unwired: curves
byPatch = Surface.ByPatch()  # unwired: closedCurve
area = Surface.Area()  # unwired: surface
function_compose = ComposeFunctions(func0=byJoinedCurves_2, func1=byPatch, func2=area)
maximumItemByKey = List.MaximumItemByKey(list=coreBoundary, keyProjector=function_compose)
# note: The Space Analysis node needs lines as inputs, not curves. To keep curves-that-are-straight properly as type "Line" rather than the curves that result from an exploded PolyCurve, the set of lines and curves that form the room boundary are preserved separately.
code_block_2 = CodeBlock(roomBoundingCrvs=maximumItemByKey) { roomBoundingCrvs; }
count = List.Count(list=sortByKey.sorted_list)
code_block_3 = CodeBlock(count=count) { count-1; }
takeItems = List.TakeItems(list=sortByKey.sorted_list, amount=code_block_3)
code_block_4 = CodeBlock(columnOutlines=takeItems) { columnOutlines; }

# group: Vector from World Origin to room centroid
byGeometry = BoundingBox.ByGeometry(geom=code_block)
maxPoint = BoundingBox.MaxPoint(boundingBox=byGeometry)
minPoint = BoundingBox.MinPoint(boundingBox=byGeometry)
code_block_5 = CodeBlock(max=maxPoint, min=minPoint)
# ---------- code_block_5.designscript (5 lines) ----------
// Find room centroid
x = Math.Average([max.X,min.X]);
y = Math.Average([max.Y,min.Y]);
z = min.Z;
Point.ByCoordinates(x,y,z);
# ----------------------------------------
asVector = Point.AsVector(point=code_block_5.out3)

boolean = BoolSelector(false)

# group: Get Revit Doc Units and Remember
number_from_feet_and_inches = LengthFromString(Value=0.3048)
python_script = Python()
# ---------- python_script.python (21 lines) ----------
# Load the Python Standard and DesignScript Libraries
import clr
#imports the Revit API
clr.AddReference('RevitAPI')
from Autodesk.Revit.DB import *
#imports revit services and the document manager
clr.AddReference('RevitServices')
import RevitServices
from RevitServices.Persistence import DocumentManager

#gets the current document
doc = DocumentManager.Instance.CurrentDBDocument

# The inputs to this node will be stored as a list in the IN variables.
dataEnteringNode = IN

# Place your code below this line
unitType = str(Document.GetUnits(doc).GetFormatOptions(UnitType.UT_Length).DisplayUnits)

# Assign your output to the OUT variable.
OUT = unitType
# ----------------------------------------
# note: We need to store the Revit units in a remember node as a string because Generative Design can't access the Revit API from Python while running design studies.
remember = Data.Remember(python_script)
code_block_6 = CodeBlock(revitProjectUnitsType=remember) { revitProjectUnitsType; }
# note: Use the Revit API in Python to retrieve the display units type used in the active document, and return a scale factor between feet and the document units. We'll use this scale factor to convert any hard-coded values in this graph (e.g. room perimeter offset depth)
get_scale_factor_python = Python(IN[0]=number_from_feet_and_inches, IN[1]=code_block_6)
# ---------- get_scale_factor_python.python (27 lines) ----------
import clr
import sys

#sets the distance to convert as input 0
distance = IN[0]
unitType = IN[1]

#builds a hard coded list of dictionary values for the conversion factors
conversionFactors = {
	"DUT_METERS":1/3.28084,
	"DUT_METERS_CENTIMETERS": 1/3.28084,
	"DUT_MILLIMETERS" : 304.8, 
	"DUT_CENTIMETERS" : 30.48, 
	"DUT_DECIMAL_FEET" : 1,
	"DUT_FEET_FRACTIONAL_INCHES": 1,
	"DUT_DECIMAL_INCHES" : 1/12, 
	"DUT_FRACTIONAL_INCHES" : 1/12
}

#gets the relevant conversion factor from the hard coded dictionary for the display units
conversion = conversionFactors[unitType]

#multiplies the conversion factor by the distance to convert
convertedValue = distance * conversion

# return the converted length value
OUT = conversion
# ----------------------------------------

# group: Obstruction zones for doors
code_block_7 = CodeBlock(roomPCrv=code_block) { roomPCrv; }
string = StringInput("OST_Doors")
byName = Category.ByName(name=string)
all_elements_of_category = ElementsOfCategory(Category=byName)
code_block_8 = CodeBlock(levelName=name) { levelName; }
# note: Threshhold for closeness btw door location point and the room wall centerline.
# The "Number From Feet and Inches" node will translate values into decimal feet. The following Python node translates that value into the units of the current Revit document.
number_from_feet_and_inches_2 = LengthFromString(Value=0.3048)
mul = number_from_feet_and_inches_2 * get_scale_factor_python
ZAxis = Vector.ZAxis()
polycurve_isclockwise = Custom[[&] PolyCurve.IsClockwise](polycurve=code_block_7)  # package Ampersand; For closed polycurves with reasonably straight segments, return true if the curve is clockwise relative to the plane, false otherwise.
# note: Door clearance into the room.
# The "Number From Feet and Inches" node will translate values into decimal feet. The following Python node translates that value into the units of the current Revit document.
number_from_feet_and_inches_3 = LengthFromString(Value=1.2192)
mul_2 = number_from_feet_and_inches_3 * get_scale_factor_python
code_block_9 = CodeBlock(isClockwise=polycurve_isclockwise, height=mul_2)
# ---------- code_block_9.designscript (4 lines) ----------
// selects direction of projection of doorway
// for the direction INTO the room.
// positive if curve is clockwise or negative otherwise
isClockwise ? (height/2) : -(height/2);
# ----------------------------------------
# note: Door width clearance.
# The "Number From Feet and Inches" node will translate values into decimal feet. The following Python node translates that value into the units of the current Revit document.
number_from_feet_and_inches_4 = LengthFromString(Value=1.2192)

level_2 = Custom[Element.Level](element=all_elements_of_category)

# group (continued): Obstruction zones for doors
name_2 = Level.Name(level=level_2)
eq = code_block_8 == name_2
# note: Only look at doors on same level as Room
filterByBoolMask = List.FilterByBoolMask(list=all_elements_of_category, mask=eq)
getLocation = Element.GetLocation(element=filterByBoolMask.in)

clean = List.Clean(list=getLocation, preserveIndices=boolean)

# group (continued): Obstruction zones for doors
closestPointTo = Geometry.ClosestPointTo(geometry=code_block_7, other=clean)
distanceTo = Geometry.DistanceTo(geometry=closestPointTo, other=clean)
le = distanceTo <= mul
# note: Door center point(s) on room bounding curve
filterByBoolMask_2 = List.FilterByBoolMask(list=closestPointTo, mask=le)
parameterAtPoint = Curve.ParameterAtPoint(curve=code_block_7, point=filterByBoolMask_2.in)
tangentAtParameter = Curve.TangentAtParameter(curve=code_block_7, param=parameterAtPoint)
cross = Vector.Cross(vector=tangentAtParameter, cross=ZAxis)
scale = Vector.Scale(vector=cross, scale_factor=code_block_9)
# note: Move the door centerpoint into the room by half the height to find the center point of the rectangle marking the necessary clearnace.
add = Point.Add(point=filterByBoolMask_2.in, vectorToAdd=scale)
byOriginNormalXAxis = Plane.ByOriginNormalXAxis(origin=add, xAxis=tangentAtParameter)

mul_3 = number_from_feet_and_inches_4 * get_scale_factor_python

# group (continued): Obstruction zones for doors
byWidthLength = Rectangle.ByWidthLength(plane=byOriginNormalXAxis, width=mul_3, length=mul_2)

# group: Window lines
code_block_10 = CodeBlock(roomPCrv=code_block) { roomPCrv; }
windows = Custom[Room.Windows](room=select_a_room)  # package Clockwork for Dynamo 2.x; Retrieves all windows that are associated with a room (hosted in walls and roofs).
solids = Element.Solids(element=windows)
explode = Geometry.Explode(geometry=solids)
flatten = List.Flatten(list=explode@L3)
code_block_11 = CodeBlock { 0.5; }
pointAtParameter = Surface.PointAtParameter(surface=flatten, u=code_block_11, v=code_block_11)
Z = Point.Z(point=pointAtParameter)
sortByKey_2 = List.SortByKey(list=flatten@L2, keys=Z@L2)
# note: Lowest surface of all window surfaces
firstItem = List.FirstItem(list=sortByKey_2.sorted_list@L2)
code_block_12 = CodeBlock { 0; 1; }
pointAtParameter_2 = Surface.PointAtParameter(surface=firstItem, u=code_block_12.out0, v=code_block_12.out0)
# note: With lowest surface of window, find closest point on the room bouding curve for the the corner points of that surface, which determines the ends of the placement lines of the window.
closestPointTo_2 = Geometry.ClosestPointTo(geometry=code_block_10, other=pointAtParameter_2)
pointAtParameter_3 = Surface.PointAtParameter(surface=firstItem, u=code_block_12.out1, v=code_block_12.out1)
closestPointTo_3 = Geometry.ClosestPointTo(geometry=code_block_10, other=pointAtParameter_3)
byStartPointEndPoint = Line.ByStartPointEndPoint(startPoint=closestPointTo_2, endPoint=closestPointTo_3)

# group: Curtain Wall Lines
boundaries = Custom[Room.Boundaries](room=select_a_room)  # package Clockwork for Dynamo 2.x; Gets a list of all boundaries of a given room or area and a corresponding list of the elements that are generating those boundaries.
code_block_13 = CodeBlock(a=boundaries.elements) { Element.GetParameterValueByName(a, "Justification") > 0 ? true : false; }
filterByBoolMask_3 = List.FilterByBoolMask(list=boundaries.curves, mask=code_block_13)

# group: All window lines
list_create = List.Create(item0=byStartPointEndPoint, item1=filterByBoolMask_3.in)
flatten_2 = List.Flatten(list=list_create)
code_block_14 = CodeBlock { null; }
ne = flatten_2 != code_block_14
# note: Filter out nulls and empty lists
filterByBoolMask_4 = List.FilterByBoolMask(list=flatten_2, mask=ne)
isEmpty = List.IsEmpty(list=filterByBoolMask_4.in)
code_block_15 = CodeBlock { null; }
python_script_2 = Python(IN[0]=isEmpty, IN[1]=code_block_15, IN[2]=filterByBoolMask_4.in)
# ---------- python_script_2.python (24 lines) ----------
# Load the Python Standard and DesignScript Libraries
import sys
import clr
clr.AddReference('ProtoGeometry')
from Autodesk.DesignScript.Geometry import *

# The inputs to this node will be stored as a list in the IN variables.
dataEnteringNode = IN

# Place your code below this line

test = IN[0]
trueCondition = IN[1]
falseCondition = IN[2]

result = ''

if (test == True):
	result = trueCondition
else: 
	result = falseCondition

# Assign your output to the OUT variable.
OUT = result
# ----------------------------------------

# group: Obstruction zones for columns
# note: Use rectangular approximation from bounding box to accommodate round columns.
boundingBox = Geometry.BoundingBox(geometry=code_block_4)
maxPoint_2 = BoundingBox.MaxPoint(boundingBox=boundingBox)
minPoint_2 = BoundingBox.MinPoint(boundingBox=boundingBox)
code_block_16 = CodeBlock(maxPt=maxPoint_2, minPt=minPoint_2)
# ---------- code_block_16.designscript (8 lines) ----------
// center point
centerX = (maxPt.X + minPt.X) / 2;
centerY = (maxPt.Y + minPt.Y) / 2;
Point.ByCoordinates(centerX, centerY, maxPt.Z);

// width and length
maxPt.X - minPt.X;
maxPt.Y - minPt.Y;
# ----------------------------------------
byOriginNormal = Plane.ByOriginNormal(origin=code_block_16.out2)
byWidthLength_2 = Rectangle.ByWidthLength(cs=byOriginNormal, width=code_block_16.out3, length=code_block_16.out4)

# group: Translate to World Origin
# note: ...because that's where the camera is that will make thumbnail shots of the geometry for each iteration.
code_block_17 = CodeBlock(vectorToRoom=asVector) { vectorToRoom; }
reverse = Vector.Reverse(vector=code_block_17)
# note: roomPCrv
translate = Geometry.Translate(geometry=code_block, direction=reverse)
# note: roomBoundingCrvs
translate_2 = Geometry.Translate(geometry=code_block_2, direction=reverse)
# note: doorRects
translate_3 = Geometry.Translate(geometry=byWidthLength, direction=reverse)
# note: windowLines
translate_4 = Geometry.Translate(geometry=python_script_2, direction=reverse)
# note: columnRects
translate_5 = Geometry.Translate(geometry=byWidthLength_2, direction=reverse)

# group: REMEMBER Room Properties
code_block_18 = CodeBlock()
# ---------- code_block_18.designscript (9 lines) ----------
[
	"levelName",
	"vectorToRoom",
	"roomPCrv",
	"roomBoundingCrvs",
	"doorRects",
	"windowLines",
	"columnRects"
];
# ----------------------------------------
# note: Remember all necessary room geometry as translated to the origin of the world coordinate system along with the vector to return the geometry to its original location.
# note: levelName
remember_2 = Data.Remember(name)
# note: vectorToRoom
remember_3 = Data.Remember(code_block_17)
# note: roomPCrv
remember_4 = Data.Remember(translate)
# note: roomBoundingCrvs
remember_5 = Data.Remember(translate_2)
# note: doorRects
remember_6 = Data.Remember(translate_3)
# note: windowLines
remember_7 = Data.Remember(translate_4)
# note: columnRects
remember_8 = Data.Remember(translate_5)
list_create_2 = List.Create(item0=remember_2, item1=remember_3, item2=remember_4, item3=remember_5, item4=remember_6, item5=remember_7, item6=remember_8)
byKeysValues = DesignScript.Builtin.Dictionary.ByKeysValues(keys=code_block_18, values=list_create_2)

# group: INPUT Desk
select_desk_family_instance = DSModelFamilyInstanceSelection()  # nothing selected; graph input

# group: Pick a desk family and extract the width and height
elementType = Element.ElementType(element=select_desk_family_instance)
origin = Point.Origin()
byPoint = FamilyInstance.ByPoint(familyType=elementType, point=origin)
boundingBox_2 = Element.BoundingBox(element=byPoint)
toCuboid = BoundingBox.ToCuboid(boundingBox=boundingBox_2)
width = Cuboid.Width(cuboid=toCuboid)
length_2 = Cuboid.Length(cuboid=toCuboid)
code_block_19 = CodeBlock(familyinstance=byPoint, boundingbox=boundingBox_2) { [familyinstance,boundingbox][0]; }
delete = Element.Delete(element=code_block_19)

# group: REMEMBER Desk Family Properties
remember_9 = Data.Remember(width)
# note: Remember Desk
# Properties
remember_10 = Data.Remember(length_2)

# group: INPUT Desk Placement
code_block_20 = CodeBlock()
# ---------- code_block_20.designscript (7 lines) ----------
[
	"deskWidth",
	"deskDepth",
	"rotationAngle",
	"deskRowOffset",
	"roomEdgeOffset"
];
# ----------------------------------------
# note: Desk Width
# The calculated width of the family instance chosen as the input desk element.
code_block_21 = CodeBlock(deskWidth=remember_9) { deskWidth; }
# note: Desk Depth
# The calculated depth of the family instance chosen as the input desk element.
code_block_22 = CodeBlock(deskDepth=remember_10) { deskDepth; }
# note: Desk Row Rotation:
# Angle (degrees) that rows of desks will be rotated relative to the room's long axis.
desk_row_rotation = DoubleSlider(0, range=-90..90 step 5)  # graph input
# note: Spacing between parallel rows of desks
spacing_between_rows_ft = DoubleSlider(10, range=10..16 step 1)  # graph input
mul_4 = spacing_between_rows_ft * get_scale_factor_python
# note: Perimeter Path Width
# This node hard-codes a number in Feet, which is always translated to the Revit project units, meaning that the length should stay constant no matter the project units.
perimeter_path_width = LengthFromString(Value=1.2192)
mul_5 = perimeter_path_width * get_scale_factor_python
list_create_3 = List.Create(item0=code_block_21, item1=code_block_22, item2=desk_row_rotation, item3=mul_4, item4=mul_5)
byKeysValues_2 = DesignScript.Builtin.Dictionary.ByKeysValues(keys=code_block_20, values=list_create_3)

# group: Desk Placement
code_block_23 = CodeBlock()
# ---------- code_block_23.designscript (7 lines) ----------
[
"deskRects",
"deskPts",
"deskVecs",
"deskCounts",
"deskOrigins"
];
# ----------------------------------------
code_block_24 = CodeBlock(roomProps=byKeysValues) { roomProps["doorRects"]; roomProps["columnRects"]; roomProps["roomPCrv"]; }
code_block_25 = CodeBlock(deskSettings=byKeysValues_2) { deskSettings; }
code_block_26 = CodeBlock(deskSettings=code_block_25) { -deskSettings["roomEdgeOffset"]; }
offset = Curve.Offset(curve=code_block_24.out2, distance=code_block_26)
byPatch_2 = Surface.ByPatch(closedCurve=offset)
flatten_3 = List.Flatten(list=byPatch_2)
# note: Planar surface that accounts for the room perimeter offset distance
firstItem_2 = List.FirstItem(list=flatten_3)
list_create_4 = List.Create(item0=code_block_24.out0, item1=code_block_24.out1)
# note: obstructions
flatten_4 = List.Flatten(list=list_create_4)
curves = PolyCurve.Curves(polyCurve=code_block_24.out2)
length_3 = Curve.Length(curve=curves)
code_block_27 = CodeBlock(deskSettings=code_block_25) { deskSettings["deskWidth"]; }
gt = length_3 > code_block_27
# note: Filter out room edges that are shorter than the width of the selected desk
filterByBoolMask_5 = List.FilterByBoolMask(list=curves, mask=gt)
tangentAtParameter_2 = Curve.TangentAtParameter(curve=filterByBoolMask_5.in)
polycurve_minboundingbox = Custom[[&] PolyCurve.MinBoundingBox](polyCurve=code_block_24.out2)  # package Ampersand; For a planar PolyCurve, find the minimum rectangular bounding box in its plane.
normalized = Vector.Normalized(vector=polycurve_minboundingbox.longAxis)
dot = Vector.Dot(vector=tangentAtParameter_2, vec=normalized)
# note: Edge of the room most aligned with the long axis of the room's bounding box, where the zero rotation angle will be set.
sortByKey_3 = List.SortByKey(list=filterByBoolMask_5.in, keys=dot)
lastItem_2 = List.LastItem(list=sortByKey_3.sorted_list)

code_block_28 = CodeBlock(surface=firstItem_2, obstructions=flatten_4, deskSettings=code_block_25, alignmentEdge=lastItem_2)
# ---------- code_block_28.designscript (7 lines) ----------
surface;
obstructions;
deskSettings["deskDepth"];
deskSettings["deskWidth"];
deskSettings["deskRowOffset"];
deskSettings["rotationAngle"];
alignmentEdge;
# ----------------------------------------
python_script_3 = Python(IN[0]=code_block_28.surface, IN[1]=code_block_28.obstructions, IN[2]=code_block_28.out2, IN[3]=code_block_28.out3, IN[4]=code_block_28.out4, IN[5]=code_block_28.out5, IN[6]=code_block_28.alignmentEdge)
# ---------- python_script_3.python (202 lines) ----------
# Enable Python support and load DesignScript library
import math
import clr

clr.AddReference('ProtoGeometry')
from Autodesk.DesignScript.Geometry import *

def countDeskFunc(k):
    return len(k)

def lenCurveFunc(k):
    return k.Length

def filterEdges(e):
	return e.Length > 1

def scaleLine(line, scale):
	midPoint = line.PointAtParameter(0.5)
	plane = Plane.ByOriginNormal(midPoint, Vector.ByCoordinates(0,0,1))
	ret = Geometry.Scale(line, plane, scale, scale, 1)
	midPoint.Dispose()
	plane.Dispose()
	return ret

def moveEdgeToRoomCorner(edge, rotatedEdge):
	# Because we only want to offset the curve in one direction to create desk rows,
	# we need to find the correct location to move the starting edge. Depending on the
	# rotation of the curve and the alignment edge, this may be the start or end point of
	# un-rotated alignment edge

	pointA = edge.StartPoint
	pointB = edge.EndPoint

	# get closest point on rotated edge from each point
	closestPtA = Geometry.ClosestPointTo(rotatedEdge, pointA)
	closestPtB = Geometry.ClosestPointTo(rotatedEdge, pointB)
	
	# draw vectors between original edge endpoints and closest points on the rotated edge
	vectorA = Vector.ByTwoPoints(pointA, closestPtA)
	vectorB = Vector.ByTwoPoints(pointB, closestPtB)
	
	tanA = edge.TangentAtParameter(edge.ParameterAtPoint(closestPtA))
	tanB = edge.TangentAtParameter(edge.ParameterAtPoint(closestPtB))

	crossA = Vector.Cross(vectorA, tanA)
	crossB = Vector.Cross(vectorB, tanB)
	
	zAxis = Vector.ByCoordinates(0, 0, 1) # World Z-Axis
	dotA = Vector.Dot(zAxis, crossA)
	dotB = Vector.Dot(zAxis, crossB)
	
	if dotA < 0 and dotB > 0:
		pickedVec = Vector.Reverse(vectorA)
	else:
		pickedVec = Vector.Reverse(vectorB)
	
	translatedEdge = Geometry.Translate(rotatedEdge, pickedVec)
	return translatedEdge

def placeRowOfDesks(s, edges, offsetEdge, offsetDir, desksGroup, deskOriginPtsGroup, deskSeatPtsGroup, deskVecsGroup, deskDepth, deskWidth, rowOffset, columns):
	dCount = 0
	deskCount = offsetEdge.Length / deskWidth
	if deskCount >= 2:
		deskPlacements = Curve.PointsAtEqualSegmentLength(offsetEdge, deskCount) #PointsAtEqualSegmentLength PointsAtEqualChordLength
		perpDir = offsetEdge.TangentAtParameter(0.5)
		deskRowCurves.append(offsetEdge)
		for deskP in deskPlacements:
			vec1 = offsetDir.Scale(deskDepth * 0.5)
			vec2 = vec1.Reverse()
			vec3 = offsetDir.Scale(deskDepth * 1.5)
			vec4 = vec3.Reverse()
			r1 = Point.Add(deskP, vec1) # center point of desk rectangle
			r2 = Point.Add(deskP, vec2) # center point of opposite desk
			r3 = Point.Add(deskP, vec3) # view points for seats
			r4 = Point.Add(deskP, vec4) # view points for seats
			desk = Rectangle.ByWidthLength(CoordinateSystem.ByOriginVectors(r1, offsetDir, perpDir), deskDepth, deskWidth)
			desk2 = Rectangle.ByWidthLength(CoordinateSystem.ByOriginVectors(r2, offsetDir, perpDir), deskDepth, deskWidth)
			intersects1 = False
			intersects2 = False
			for col in columns:
				if Geometry.DoesIntersect(col, desk):
					intersects1 = True
				if Geometry.DoesIntersect(col, desk2):
					intersects2 = True
			for e in edges:
				if Geometry.DoesIntersect(e, desk):
					intersects1 = True
				if Geometry.DoesIntersect(e, desk2):
					intersects2 = True	
			
			if not intersects1 and Geometry.DoesIntersect(s, desk):
				desksGroup.append(desk)
				dCount += 1
				p1 = Geometry.Translate(r1, offsetDir, deskDepth/2)
				p1 = Geometry.Translate(p1, perpDir, deskWidth/2)
				deskOriginPtsGroup.append(p1)
				deskSeatPtsGroup.append(r3)
				deskVecsGroup.append(Vector.ByTwoPoints(r3, r1))
			else:
				desk.Dispose()
				r3.Dispose()
			
			if not intersects2 and Geometry.DoesIntersect(s, desk2):
				desksGroup.append(desk2)
				dCount += 1
				p2 = Geometry.Translate(r2, Vector.Reverse(offsetDir), deskDepth/2)
				p2 = Geometry.Translate(p2, Vector.Reverse(perpDir), deskWidth/2)
				deskOriginPtsGroup.append(p2)
				deskSeatPtsGroup.append(r4)
				deskVecsGroup.append(Vector.ByTwoPoints(r4, r2))
			else:
				desk2.Dispose()
				r4.Dispose()
		
		perpDir.Dispose()
	return dCount
	
# The inputs to this node will be stored as a list in the IN variables.
surface = IN[0]
allColumns = IN[1]
deskDepth = IN[2]
deskWidth = IN[3]
rowOffset = IN[4]
edgeRotationAngle = IN[5]
edge = IN[6]


deskRects = []
deskSeatPts = []
deskVecs = []
deskCounts = []
deskOrigins = []
deskRowCurves = []
points = []

if surface and allColumns:
	# figure out direction
	deskCount = 0
	desksGroup = []
	deskOriginPtsGroup = []
	deskSeatPtsGroup = []
	deskVecsGroup = []

	edges = surface.PerimeterCurves()
	centerPt = surface.PointAtParameter(0.5, 0.5)
	planeOrigin = edge.PointAtParameter(0.5)
	pln1 = Plane.ByOriginNormal(planeOrigin, Vector.ByCoordinates(0.0,0.0, 1.0))

	if edgeRotationAngle != 0:
		rotatedEdge = Geometry.Rotate(edge, pln1, edgeRotationAngle)
		startEdge = moveEdgeToRoomCorner(edge, rotatedEdge)
	else:
		startEdge = edge

	midpoint = startEdge.PointAtParameter(0.5)

	offsetDir0 = Vector.ByTwoPoints(midpoint, centerPt)
	offsetDir1 = startEdge.NormalAtParameter(0.5)
	offsetDir2 = Vector.Reverse(offsetDir1)
	offsetDir = offsetDir1
	if Vector.AngleWithVector(offsetDir0, offsetDir1) > 90:
		offsetDir = offsetDir2
	
	j = 0
	while True:
		if j == 0:
			rowOffset = rowOffset / 2
		else:
			rowOffset = rowOffset
		
		offsetAmount = (rowOffset + deskDepth) + ((rowOffset + (deskDepth*2)) * j)
		offset =  str(j) + ": " + str(offsetAmount)
		offsetEdge = Geometry.Translate(startEdge, offsetDir, offsetAmount)
		offsetEdge2 = scaleLine(offsetEdge, 20)
		offsetEdge3 = Geometry.Intersect(surface, offsetEdge2)
		if offsetEdge3:
			dCount = placeRowOfDesks(surface, edges, offsetEdge3[0], offsetDir, desksGroup, deskOriginPtsGroup, deskSeatPtsGroup, deskVecsGroup, deskDepth, deskWidth, rowOffset, allColumns)
			deskCount += dCount
		offsetEdge.Dispose()
		offsetEdge2.Dispose()
		#for e in offsetEdge3:
		#	e.Dispose()
		
		if not offsetEdge3:
			break
		j += 1
	
	centerPt.Dispose()
	midpoint.Dispose()
	offsetDir.Dispose()
	offsetDir0.Dispose()
	offsetDir1.Dispose()
	offsetDir2.Dispose()
	
	deskRects = desksGroup
	deskSeatPts = deskSeatPtsGroup
	deskVecs = deskVecsGroup
	deskCounts = deskCount
	deskOrigins = deskOriginPtsGroup

# Assign output to the OUT variable.
OUT = [deskRects, deskSeatPts, deskVecs, deskCounts, deskOrigins]
# ----------------------------------------

# group (continued): Desk Placement
# note: deskPlacement
code_block_29 = CodeBlock(a=python_script_3) { [a[0],a[1],a[2],a[3],a[4]]; }
byKeysValues_3 = DesignScript.Builtin.Dictionary.ByKeysValues(keys=code_block_23, values=code_block_29)

# group: Scale Factor for Unit Conversion
code_block_30 = CodeBlock(conversionFactor=get_scale_factor_python) { conversionFactor; }

# group: Path Lattice
code_block_31 = CodeBlock(roomProps=byKeysValues) { roomProps["roomPCrv"]; roomProps["roomBoundingCrvs"]; roomProps["columnRects"]; }
byGeometry_2 = BoundingBox.ByGeometry(geom=code_block_31.out0)
code_block_32 = CodeBlock(deskPlacement=byKeysValues_3) { deskPlacement["deskRects"]; }
list_create_5 = List.Create(item0=code_block_32, item1=code_block_31.out1, item2=code_block_31.out2)
flatten_5 = List.Flatten(list=list_create_5)
# note: Curve Approximation Segment Length
# The "Number From Feet and Inches" node will translate values into decimal feet. The following Python node translates that value into the units of the current Revit document.
segment_length = LengthFromString(Value=1.524)
mul_6 = segment_length * code_block_30
approximateCurvesWithLines = Custom[Utils.ApproximateCurvesWithLines](curves=flatten_5, segmentLength=mul_6)  # package SpaceAnalysis; Approximate Curves With Lines
# note: SpaceLattice Resolution
# The "Number From Feet and Inches" node will translate values into decimal feet. The following Python node translates that value into the units of the current Revit document.
spacelattice_resolution = LengthFromString(Value=0.6096)
mul_7 = spacelattice_resolution * code_block_30
byBoundingBoxAndLines = Core.SpaceLattice.ByBoundingBoxAndLines(boundingBox=byGeometry_2, barriers=approximateCurvesWithLines, resolution=mul_7)

# group: Doorway Landmark Points
# note: Can take as a given that the door rectangles are inside the room boundary because of the logic used to find them in the first place.
# Can take as a given that the room boundary and door rectangles are on the XY plane since we translated everything to the origin for calculation purposes.
code_block_33 = CodeBlock(roomProps=byKeysValues) { roomProps["doorRects"]; }
explode_2 = Geometry.Explode(geometry=code_block_33)
pointAtParameter_4 = Curve.PointAtParameter(curve=explode_2)
X = Point.X(point=pointAtParameter_4)
average = Math.Average(numbers=X)
Y = Point.Y(point=pointAtParameter_4)
average_2 = Math.Average(numbers=Y)
byCoordinates = Point.ByCoordinates(x=average, y=average_2)

# group: Find Shortest Paths
code_block_34 = CodeBlock(pathLattice=byBoundingBoxAndLines) { pathLattice; }
code_block_35 = CodeBlock(landmarks=byCoordinates) { landmarks; }
closestPointTo_4 = Core.SpaceLattice.ClosestPointTo(spaceLattice=code_block_34, point=code_block_35)
bySpaceLatticeAndEndPoint = Pathfinding.PathField.BySpaceLatticeAndEndPoint(spaceLattice=code_block_34, endPoint=closestPointTo_4)
code_block_36 = CodeBlock(deskPlacement=byKeysValues_3) { deskPlacement["deskPts"]; }
closestPointTo_5 = Core.SpaceLattice.ClosestPointTo(spaceLattice=code_block_34, point=code_block_36)
byPathField = Pathfinding.Route.ByPathField(pathField=bySpaceLatticeAndEndPoint, otherPoint=closestPointTo_5, lacing=CrossProduct)
count_2 = Pathfinding.Route.Count(route=byPathField)
# note: Penalize desks that are inaccessible
python_script_4 = Python(IN[0]=count_2)
# ---------- python_script_4.python (19 lines) ----------
# Penalize desks that are inaccessible
import sys
import clr
clr.AddReference('ProtoGeometry')
from Autodesk.DesignScript.Geometry import *

# The inputs to this node will be stored as a list in the IN variables.
counts = IN[0]
outC = []
maxVal  = max(counts)
# Place your code below this line
for c in counts:
	if c == 0:
		outC.append(maxVal)
	else:
		outC.append(c)	
		
# Assign your output to the OUT variable.
OUT = outC
# ----------------------------------------
code_block_37 = CodeBlock(route=byPathField, routeLen=python_script_4) { route; routeLen; }
# note: Choose shortest path between each desk and each door
python_script_5 = Python(IN[0]=code_block_37.route, IN[1]=code_block_37.routeLen)
# ---------- python_script_5.python (41 lines) ----------
# Among the paths from each desk to each door, chose the shortest path
import sys
import clr
clr.AddReference('ProtoGeometry')
from Autodesk.DesignScript.Geometry import *

route = IN[0]
routeLen = IN[1]


# Number of doors and desks
numDoors = 1
numDesks = 1
if isinstance(route, list):
	if isinstance(route[0], list):
		numDoors = len(route)
		numDesks = len(route[0])
	else:
		numDesks = len(route)
elif not route:
	numDoors = 0
	numDesks = 0

# Chose shortest paths
path = []
pathLen = []
if numDoors == 1:
	path = route
	pathLen = routeLen
elif numDoors > 1 and numDesks >= 1:
	for desk in range(numDesks):
		closestDoor = 0
		shortestLen = routeLen[0][desk]
		for door in range(1, numDoors):
			if routeLen[door][desk] < shortestLen:
				shortestLen = routeLen[door][desk]
				closestDoor = door
		path.append(route[closestDoor][desk])
		pathLen.append(routeLen[closestDoor][desk])

OUT = [path,pathLen]
# ----------------------------------------
code_block_38 = CodeBlock(a=python_script_5) { routes = a[0]; pathLen = a[1]; }

# group: Metric: Average Distance to Egress
code_block_39 = CodeBlock(pathLengths=code_block_38.pathLen) { pathLengths; }
flatten_6 = List.Flatten(list=code_block_39)
average_3 = Math.Average(numbers=flatten_6)
average_distance_to_exits = Watch(average_3)  # graph output

# group: Visibility Lattice
code_block_40 = CodeBlock(roomProps=byKeysValues) { roomProps["roomBoundingCrvs"]; roomProps["columnRects"]; }
list_create_6 = List.Create(item0=code_block_40.out0, item1=code_block_40.out1)
boolean_2 = BoolSelector(false)
clean_2 = List.Clean(list=list_create_6, preserveIndices=boolean_2)
flatten_7 = List.Flatten(list=clean_2)
approximateCurvesWithLines_2 = Custom[Utils.ApproximateCurvesWithLines](curves=flatten_7)
byGeometry_3 = BoundingBox.ByGeometry(geom=approximateCurvesWithLines_2)
# note: Visibility analysis grid resolution
# The "Number From Feet and Inches" node will translate values into decimal feet. The following Python node translates that value into the units of the current Revit document.
code_block_41 = CodeBlock { 1; }
mul_8 = code_block_41 * code_block_30
# note: visibilityLattice
byBoundingBoxAndLines_2 = Core.SpaceLattice.ByBoundingBoxAndLines(boundingBox=byGeometry_3, barriers=approximateCurvesWithLines_2, resolution=mul_8)

# group: Window Visibility Grid
code_block_42 = CodeBlock(visibilityLattice=byBoundingBoxAndLines_2) { visibilityLattice; }
code_block_43 = CodeBlock(roomProps=byKeysValues) { roomProps["roomPCrv"]; roomProps["windowLines"]; }
# note: Max distance between window view calculation points
# The "Number From Feet and Inches" node will translate values into decimal feet. The following Python node translates that value into the units of the current Revit document.
convert_to_document_units_python = LengthFromString(Value=0.6096)
mul_9 = convert_to_document_units_python * code_block_30
code_block_44 = CodeBlock(curve=code_block_43.out1, segLength=mul_9) { segments = Math.Max(3, Math.Floor((Autodesk.Curve.Length(curve)) / segLength)); seq = (0..1..#segments); }
pointAtParameter_5 = Curve.PointAtParameter(curve=code_block_43.out1, param=code_block_44.seq)
# note: View calculation points
flatten_8 = List.Flatten(list=pointAtParameter_5)
closestPointTo_6 = Core.SpaceLattice.ClosestPointTo(spaceLattice=code_block_42, point=flatten_8)
flatten_9 = List.Flatten(list=closestPointTo_6)
byPatch_3 = Surface.ByPatch(closedCurve=code_block_43.out0)
doesIntersect = Geometry.DoesIntersect(geometry=byPatch_3, other=flatten_9@L1)
flatten_10 = List.Flatten(list=doesIntersect)
filterByBoolMask_6 = List.FilterByBoolMask(list=flatten_9, mask=flatten_10)
code_block_45 = CodeBlock(viewPts=filterByBoolMask_6.in) { viewPts; }

# group: Metric: Views to Outside
code_block_46 = CodeBlock(visibilityLattice=byBoundingBoxAndLines_2) { visibilityLattice; }
code_block_47 = CodeBlock(deskPlacement=byKeysValues_3) { deskPlacement["deskPts"]; deskPlacement["deskVecs"]; }
# note: Distance Threshold
# The "Number From Feet and Inches" node will translate values into decimal feet. The following Python node translates that value into the units of the current Revit document.
distance_threshold = LengthFromString(Value=12.192)
mul_10 = distance_threshold * code_block_30
code_block_48 = CodeBlock(viewPts=code_block_45) { viewPts; }
python_script_6 = Python(IN[0]=code_block_46, IN[1]=code_block_47.out0, IN[2]=code_block_47.out1, IN[3]=mul_10, IN[4]=code_block_48)
# ---------- python_script_6.python (48 lines) ----------
import sys
import clr

clr.AddReference('ProtoGeometry')
clr.AddReference('SpaceAnalysis')
from Autodesk.DesignScript.Geometry import *
from Visibility import *

def Average(lst): 
    return sum(lst) / len(lst) 

visibilityLattice = IN[0]
deskPoints = IN[1] #deskPts
deskVecs = IN[2]
distanceThreshold = IN[3]
windowPoints = IN[4]

resultsCount = [0 for x in range(len(deskPoints))]
resultsDist = [0 for x in range(len(deskPoints))]
resultsPts = [0 for x in range(len(deskPoints))]

def calculateViewsToOutside(point, pt_o, i, visLattice, distanceThreshold, windowPoints, resultsC, resultsD, resultsPts):
	if len(windowPoints) > 0:
		viewField = ViewField.BySpaceLatticeAndViewPoint(visLattice, point, distanceThreshold)
		visGrid = VisibilityGrid.ByViewField(viewField)
		count = 0
		distances = []
		minD = 9999999
		for window in windowPoints:	
			if(visGrid.ValueAtPoint(window) > 0.1):
				vecToPoint = Vector.ByTwoPoints(point, window)
				angle = pt_o.AngleWithVector(vecToPoint)
				if angle <= 110:
					d = Geometry.DistanceTo(point, window)
					if d < minD:
						resultsPts[i] = window
						minD = d
					count += 1.0
					distances.append(d)
		resultsC[i] = count
		if len(distances) > 0:
			resultsC[i] *= (1 / Average(distances))
			resultsD[i] = min(distances)
		
for i, point in enumerate(deskPoints):
	calculateViewsToOutside(point, deskVecs[i], i, visibilityLattice, distanceThreshold, windowPoints, resultsCount, resultsDist, resultsPts)

OUT = [resultsCount, resultsDist, resultsPts]
# ----------------------------------------
code_block_49 = CodeBlock(a=python_script_6) { normDist = a[0]; dists = a[1]; windows = a[2]; }
minimumItem = List.MinimumItem(list=code_block_49.normDist)
maximumItem = List.MaximumItem(list=code_block_49.normDist)
map = Math.Map(rangeMin=minimumItem, rangeMax=maximumItem, inputValue=code_block_49.normDist)
average_4 = Math.Average(numbers=map)
views_to_outside = Watch(average_4)  # graph output
code_block_50 = CodeBlock(rawDists=code_block_49.dists) { rawDists; }
code_block_51 = CodeBlock(windowPts=code_block_49.windows) { windowPts; }
code_block_52 = CodeBlock(viewsToOutsidePerDesk=map) { viewsToOutsidePerDesk; }

# group: Display Distance to nearest exit per desk
code_block_53 = CodeBlock(deskPlacement=byKeysValues_3) { deskPlacement["deskRects"]; }
byPatch_4 = Surface.ByPatch(closedCurve=code_block_53)
code_block_54 = CodeBlock()
# ---------- code_block_54.designscript (3 lines) ----------
[DSCore.Color.ByARGB(255, 0, 255, 0),
 DSCore.Color.ByARGB(255, 255, 0, 0)];
[0, 1];
# ----------------------------------------
code_block_55 = CodeBlock(pathLengths=code_block_39) { pathLengths; }
minimumItem_2 = List.MinimumItem(list=code_block_55)
maximumItem_2 = List.MaximumItem(list=code_block_55)
code_block_56 = CodeBlock { 0; 1; }
mapTo = Math.MapTo(rangeMin=minimumItem_2, rangeMax=maximumItem_2, inputValue=code_block_55, targetRangeMin=code_block_56.out0, targetRangeMax=code_block_56.out1)
color_range = ColorRange(colors=code_block_54.out0, indices=code_block_54.out1, value=mapTo)
flatten_11 = List.Flatten(list=color_range)
byGeometryColor = Modifiers.GeometryColor.ByGeometryColor(geometry=byPatch_4, color=flatten_11)

# group: Metric: Desk Count
code_block_57 = CodeBlock(deskPlacement=byKeysValues_3) { deskPlacement["deskCounts"]; }
number_of_desks = Watch(code_block_57)  # graph output

# group: Display Room Geometry
code_block_58 = CodeBlock(roomProps=byKeysValues) { roomProps["roomPCrv"]; roomProps["columnRects"]; roomProps["doorRects"]; roomProps["windowLines"]; }
color_palette = ColorPalette({R: 169, G: 169, B: 169, A: 255})
# note: Door obstruction zones
byGeometryColor_2 = Modifiers.GeometryColor.ByGeometryColor(geometry=code_block_58.out2, color=color_palette)
code_block_59 = CodeBlock { 0.5; }
normalAtParameter = Curve.NormalAtParameter(curve=code_block_58.out3, param=code_block_59)
# note: Max distance between window view calculation points
# The "Number From Feet and Inches" node will translate values into decimal feet. The following Python node translates that value into the units of the current Revit document.
number_from_feet_and_inches_5 = LengthFromString(Value=0.1524)
mul_11 = number_from_feet_and_inches_5 * get_scale_factor_python
code_block_60 = CodeBlock(dist=mul_11) { [-dist,dist]; }
translate_6 = Geometry.Translate(geometry=code_block_58.out3@L1, direction=normalAtParameter@L1, distance=code_block_60)
color_palette_2 = ColorPalette({R: 0, G: 191, B: 255, A: 255})
# note: Window lines
byGeometryColor_3 = Modifiers.GeometryColor.ByGeometryColor(geometry=translate_6, color=color_palette_2)
list_create_7 = List.Create(item0=code_block_58.out0, item1=code_block_58.out1)
color_palette_3 = ColorPalette({R: 0, G: 0, B: 0, A: 255})
# note: Room outline
byGeometryColor_4 = Modifiers.GeometryColor.ByGeometryColor(geometry=list_create_7, color=color_palette_3)
byPatch_5 = Surface.ByPatch(closedCurve=code_block_58.out1)
color_palette_4 = ColorPalette({R: 0, G: 0, B: 0, A: 255})
# note: Column fill
byGeometryColor_5 = Modifiers.GeometryColor.ByGeometryColor(geometry=byPatch_5, color=color_palette_4)

# group: Display Desk Outlines
code_block_61 = CodeBlock(deskPlacement=byKeysValues_3) { deskPlacement["deskRects"]; }
color_palette_5 = ColorPalette({R: 0, G: 0, B: 0, A: 255})
byGeometryColor_6 = Modifiers.GeometryColor.ByGeometryColor(geometry=code_block_61, color=color_palette_5)

# group: Display Views to Outside
code_block_62 = CodeBlock(deskPlacement=byKeysValues_3) { deskPlacement["deskPts"]; deskPlacement["deskVecs"]; }
code_block_63 = CodeBlock(rawDists=code_block_50) { rawDists; }
code_block_64 = CodeBlock(windowPts=code_block_51) { windowPts; }
python_script_7 = Python(IN[0]=code_block_62.out0, IN[1]=code_block_62.out1, IN[2]=code_block_63, IN[3]=code_block_64)
# ---------- python_script_7.python (46 lines) ----------
import sys
import clr
clr.AddReference('ProtoGeometry')
from Autodesk.DesignScript.Geometry import *

# The inputs to this node will be stored as a list in the IN variables.
pts = IN[0]
dirs = IN[1]
dists = IN[2]
windows = IN[2]
curves = []
curves2 = []

for i, pt in enumerate(pts):
	dir = dirs[i]
	v1 = Vector.Rotate(dir, Vector.ZAxis(), -110)
	v2 = Vector.Rotate(dir, Vector.ZAxis(), 110)
	if windows[i] == 0:
		v3 = v1.Scale(0.4)
		v4 = v2.Scale(0.4)
	else:
		v3 = v1.Scale(0.4)
		v4 = v2.Scale(0.4)
	sPt = Point.Add(pt, v3)
	ePt = Point.Add(pt, v4)
	arc = Arc.ByCenterPointStartPointEndPoint(pt, sPt, ePt)
	line1 = Line.ByStartPointEndPoint(sPt, pt)
	line2 = Line.ByStartPointEndPoint(pt, ePt) 
	pc = PolyCurve.ByJoinedCurves([line1, line2, arc], 0.001)

	sPt.Dispose()
	ePt.Dispose()
	v1.Dispose()
	v2.Dispose()
	v3.Dispose()
	v4.Dispose()
	line1.Dispose()
	line2.Dispose()

	if windows[i] == 0:
		curves2.append(pc)
	else:
		curves.append(pc)
	

OUT = [curves, curves2]
# ----------------------------------------
code_block_65 = CodeBlock(a=python_script_7) { a[0]; a[1]; }
code_block_66 = CodeBlock(viewsToOutside=code_block_52)
# ---------- code_block_66.designscript (6 lines) ----------
[DSCore.Color.ByARGB(128, 255, 0, 0),
DSCore.Color.ByARGB(128, 0, 255, 0)];

[0, 1];

viewsToOutside;
# ----------------------------------------
color_range_2 = ColorRange(colors=code_block_66.out0, indices=code_block_66.out1, value=code_block_66.viewsToOutside)
code_block_67 = CodeBlock(a=code_block_64) { a == 0; }
filterByBoolMask_7 = List.FilterByBoolMask(list=color_range_2, mask=code_block_67)
byGeometryColor_7 = Modifiers.GeometryColor.ByGeometryColor(geometry=code_block_65.out1, color=filterByBoolMask_7.in)
byPatch_6 = Surface.ByPatch(closedCurve=code_block_65.out0)
filterByBoolMask_8 = List.FilterByBoolMask(list=code_block_62.out0, mask=code_block_67)
filterByBoolMask_9 = List.FilterByBoolMask(list=code_block_64, mask=code_block_67)
byStartPointEndPoint_2 = Line.ByStartPointEndPoint(startPoint=filterByBoolMask_8.out, endPoint=filterByBoolMask_9.out)
list_create_8 = List.Create(item0=byPatch_6, item1=byStartPointEndPoint_2)
list_create_9 = List.Create(item0=filterByBoolMask_7.out, item1=filterByBoolMask_7.out)
byGeometryColor_8 = Modifiers.GeometryColor.ByGeometryColor(geometry=list_create_8, color=list_create_9)

# group: Display Egress Paths
code_block_68 = CodeBlock(routes=code_block_38.routes) { routes; }
curve = Pathfinding.Route.Curve(route=code_block_68)
code_block_69 = CodeBlock { false; }
clean_3 = List.Clean(list=curve, preserveIndices=code_block_69)
color_palette_6 = ColorPalette({R: 211, G: 211, B: 211, A: 255})
byGeometryColor_9 = Modifiers.GeometryColor.ByGeometryColor(geometry=clean_3, color=color_palette_6)

# group: FamilyType of selected desk instance
name_3 = FamilyType.Name(familyType=select_desk_family_instance)
byName_2 = FamilyType.ByName(name=name_3)

# group: Gate Node
code_block_70 = CodeBlock(roomProps=byKeysValues, deskFamily=byName_2, deskSettings=byKeysValues_2, deskPlacement=byKeysValues_3)
# ---------- code_block_70.designscript (4 lines) ----------
[roomProps,
deskFamily,
deskSettings,
deskPlacement];
# ----------------------------------------
gate = Data.Gate(false, code_block_70)
code_block_71 = CodeBlock(a=gate) { roomProps     = a[0]; deskFamily    = a[1]; deskSettings  = a[2]; deskPlacement = a[3]; }

# group: Translate Desk Origins to Revit Placement Points
code_block_72 = CodeBlock(roomProps=code_block_71.roomProps, deskPlacement=code_block_71.deskPlacement, deskSettings=code_block_71.deskSettings)
# ---------- code_block_72.designscript (5 lines) ----------
roomProps["vectorToRoom"];
deskPlacement["deskOrigins"];
deskPlacement["deskVecs"];
deskSettings["deskWidth"];
deskSettings["deskDepth"];
# ----------------------------------------
normalized_2 = Vector.Normalized(vector=code_block_72.out2)
# note: Each Revit family instance must be placed according to the placement point and the orientation as designed in the family file itself. The Revit sample content desk used here is designed so that the placement point is 1.5" inset from both the width and the depth directions from the back right corner when viewed from the front of the desk. When a new family is chosen to be placed by this script, this group will have to be updated to ensure that the furniture placement is as intended, or you can use the offset inputs in the width (family X-axis) and depth (family Y-axis) directions to line up your family with where it should go.
# Tip: a quick way to check a family's design specifications are to open the family file and open a new Dynamo script with that family file. Use the node "Select Model Elements" to select all the model geometry then the node "Element.Geometry" to show that geometry relative to the X/Y/Z axes in the Dynamo context. You can see which way the front faces (along which axis), and where the Revit placement point is--perhaps at a corner or at the center.
# note: Desk placement point offset from back right corner in the direction of the desk DEPTH
# The "Number From Feet and Inches" node will translate values into decimal feet. The following Python node translates that value into the units of the current Revit document.
number_from_feet_and_inches_6 = LengthFromString(Value=0.0381)
mul_12 = number_from_feet_and_inches_6 * code_block_30
sub = code_block_72.out4 - mul_12
scale_2 = Vector.Scale(vector=normalized_2, scale_factor=sub)
ZAxis_2 = Vector.ZAxis()
code_block_73 = CodeBlock { -90; }
rotate = Vector.Rotate(vector=normalized_2, axis=ZAxis_2, degrees=code_block_73)
# note: Desk placement point offset from back right corner in the direction of the desk WIDTH
# The "Number From Feet and Inches" node will translate values into decimal feet. The following Python node translates that value into the units of the current Revit document.
number_from_feet_and_inches_7 = LengthFromString(Value=0.01905)
mul_13 = number_from_feet_and_inches_7 * code_block_30
sub_2 = code_block_72.out3 - mul_13
scale_3 = Vector.Scale(vector=rotate, scale_factor=sub_2)
# note: The deskOrigin points calculated by this script give the point at the front left corner of where the desk should be placed, so the they will have to be translated to the back right corner before sending to Revit.
add_2 = Vector.Add(vector=scale_2, vectorToAdd=scale_3)
# note: Earlier in the script, the room geometry was extracted then translated from where the room exists in the Revit coordinate system to the world origin. This was to center the geometry and analytics display where the camera would see it most easily when thumbnail images are created by the Generative Design tool. This also has the effect of reducing errors in numerical calculations downstream in the graph when the distances from the world origin are large. The initial translation does not alter the analytic outputs or the subsequent optimization, but before we use the result to place instances of desk in Revit, we will need to translate the desk origins back from the world origin to where the Revit Room actually is.
add_3 = Vector.Add(vector=add_2, vectorToAdd=code_block_72.out0)
translate_7 = Geometry.Translate(geometry=code_block_72.out1, direction=add_3)

# group: Revit Level
categories = Categories("OST_Levels")
all_elements_of_category_2 = ElementsOfCategory(Category=categories)
code_block_74 = CodeBlock(roomProps=code_block_71.roomProps) { roomProps["levelName"]; }
name_4 = Element.Name(element=all_elements_of_category_2)
eq_2 = code_block_74 == name_4
# note: Find the Revit level element corresponding to the name of the room's level
filterByBoolMask_10 = List.FilterByBoolMask(list=all_elements_of_category_2, mask=eq_2)
firstItem_3 = List.FirstItem(list=filterByBoolMask_10.in)

# group: Place Desk Instances
byPointAndLevel = FamilyInstance.ByPointAndLevel(familyType=code_block_71.deskFamily, point=translate_7, level=firstItem_3)

# group: Family Rotation Angle
# note: The Revit sample content desk is oriented so that while seated at the desk, a chair would be facing the negative Y-axis or you can imagine the drawer faces point toward the positive Y-axis.
# Revit measures family rotation in degrees clockwise from the positive Y-Axis. This group translates the orientation vector of the desk to the degrees for family rotation that would mean the same thing for Revit. (Here we use the negative Y-axis because the orientation vector that's calculated would line up with the negative Y-axis if the angle of rotation were zero. Your family file may vary.)
code_block_75 = CodeBlock(deskPlacement=code_block_71.deskPlacement) { deskPlacement["deskVecs"]; }
normalized_3 = Vector.Normalized(vector=code_block_75)
YAxis = Vector.YAxis()
reverse_2 = Vector.Reverse(vector=YAxis)
cross_2 = Vector.Cross(vector=normalized_3, cross=reverse_2)
Z_2 = Vector.Z(vector=cross_2)
dot_2 = Vector.Dot(vector=normalized_3, vec=reverse_2)
# note: The Python code handles an edge cases where all of the Vector.Z values are zero, and the rotation calculation fail. In most cases, the equation for the angle is: "Math.Sign(z) * arccosine(dot)"
python_script_8 = Python(IN[0]=Z_2, IN[1]=dot_2)
# ---------- python_script_8.python (44 lines) ----------
# Load the Python Standard and DesignScript Libraries
import sys
import clr
import math
clr.AddReference('ProtoGeometry')
from Autodesk.DesignScript.Geometry import *

# The inputs to this node will be stored as a list in the IN variables.
zComps = IN[0]
dots = IN[1]

# Place your code below this line

def signum(x):
	if x == 0:
		y = 0
	elif x > 0:
		y = 1
	elif x < 0:
		y = -1
	return y

allZeroes = True
rotations = []

for item in zComps:
	if item != 0:
		allZeroes = False
		break

if allZeroes == True:
	for dot in dots:
		r = math.acos(dot) * -1
		math.degrees(r)
		rotations.append(r)
else:
	for i, z in enumerate(zComps):
		r = signum(z) * math.acos(dots[i])
		rotations.append(r)
	


# Assign your output to the OUT variable.
OUT = [rotations, allZeroes]
# ----------------------------------------
code_block_76 = CodeBlock(a=python_script_8) { rotations = a[0]; }
radiansToDegrees = Math.RadiansToDegrees(radians=code_block_76)

# group: Rotate Family Instances
setRotation = FamilyInstance.SetRotation(familyInstance=byPointAndLevel, degree=radiansToDegrees)
